# Grasshopper definition CALLINGHOUSE.gh (Grasshopper 1.0.8)

units = Data()  # disabled

elements = Data()  # disabled
boolean_toggle = BooleanToggle(True)  # disabled
python_3_script = Python3Script(RUN=boolean_toggle, units=units, elements=elements)  # -> out, csv_path, db_path, json_path, success; inputs units: list, elements: list; disabled
# ---------- python_3_script: Python ----------
import csv
import os
import sqlite3
import json

def safe_extract(value, default=0.0):
    if value is None:
        return default
    if isinstance(value, list):
        return value[0] if value else default
    return value

def extract_panel_data(units):
    return [[str(unit.unit_id or ""), str(unit.unit_name or ""), str(unit.orientation or ""), 
             str(unit.level or ""), str(panel.name or ""), 
             float(safe_extract(panel.wwr, 0.0)), 
             str(safe_extract(panel.orientation, "")), 
             float(safe_extract(panel.sda, 0.0)), 
             float(safe_extract(panel.viewscore, 0.0)), 
             float(safe_extract(panel.radiation, 0.0)), 
             str(safe_extract(panel.connected_room, "")), 
             str(safe_extract(panel.architectural_geometry.description, ""))]
            for unit in units for panel in unit.panels]

def extract_element_data(elements):
    return [[elem._id, elem.description, len(elem.glass), len(elem.solid), 
             elem.source_plane is not None, len(elem.glass) + len(elem.solid)]
            for elem in elements]

def create_database(db_path, panel_data, element_data):
    conn = sqlite3.connect(db_path)
    cursor = conn.cursor()
    
    # facade_sql table
    cursor.execute("DROP TABLE IF EXISTS building_sql")
    cursor.execute("""CREATE TABLE building_sql (unit_id TEXT, unit_name TEXT, unit_orientation TEXT, 
                      unit_level TEXT, panel_name TEXT, WWR REAL, panel_orientation TEXT, sda REAL,
                      viewscore REAL, radiation REAL, connected_room TEXT, component TEXT)""")
    cursor.executemany("INSERT INTO building_sql VALUES (?,?,?,?,?,?,?,?,?,?,?,?)", panel_data)
    
    # facade_elements table
    cursor.execute("DROP TABLE IF EXISTS components_library")
    cursor.execute("""CREATE TABLE components_library (element_id TEXT, description TEXT, glass_count INTEGER,
                      solid_count INTEGER, has_source_plane BOOLEAN, total_geometries INTEGER)""")
    cursor.executemany("INSERT INTO components_library VALUES (?,?,?,?,?,?)", element_data)
    
    conn.commit()
    conn.close()

def create_json_descriptions(folder, facade_sql_desc, facade_elements_desc):
    os.makedirs(os.path.join(folder, "knowledge"), exist_ok=True)
    json_path = os.path.join(folder, "knowledge", "table_descriptions.json")
    
    data = [
        {"name": "building_sql", "content": facade_sql_desc, "vector": []},
        {"name": "components_library", "content": facade_elements_desc, "vector": []}
    ]
    
    with open(json_path, 'w') as f:
        json.dump(data, f, indent=2)
    return json_path

def verify_csv(csv_path):
    with open(csv_path, 'r') as f:
        reader = csv.reader(f)
        headers = next(reader)
        rows = list(reader)
    print(f"CSV: {len(headers)} columns, {len(rows)} rows")
    return len(rows) > 0

def verify_database(db_path):
    conn = sqlite3.connect(db_path)
    cursor = conn.cursor()
    
    cursor.execute("SELECT name FROM sqlite_master WHERE type='table'")
    tables = [row[0] for row in cursor.fetchall()]
    
    for table in tables:
        cursor.execute(f"SELECT COUNT(*) FROM {table}")
        count = cursor.fetchone()[0]
        print(f"Table '{table}': {count} rows")
    
    conn.close()
    return len(tables) == 2

def verify_json(json_path):
    with open(json_path, 'r') as f:
        data = json.load(f)
    print(f"JSON: {len(data)} table descriptions")
    return all('name' in item and 'content' in item for item in data)

# Main execution
if RUN:
    headers = ['unit_id','unit_name','unit_orientation','unit_level','panel_name','WWR',
               'panel_orientation','sda','viewscore','radiation','connected_room','component']
    
    panel_data = extract_panel_data(units)
    element_data = extract_element_data(elements)
    
    # Create CSV
    csv_path = os.path.join(folder, 'building_data.csv')
    with open(csv_path, 'w', newline='') as f:
        writer = csv.writer(f)
        writer.writerow(headers)
        writer.writerows(panel_data)
    
    # Create database
    db_path = os.path.join(folder, "building_data.db")
    create_database(db_path, panel_data, element_data)
    
    # Create JSON descriptions
    json_path = create_json_descriptions(folder, facade_sql_table_description, facade_elements_table_description)
    
    print(f"Created: CSV({len(panel_data)} rows), DB(2 tables), JSON")

    # Verify everything works
    csv_ok = verify_csv(csv_path)
    db_ok = verify_database(db_path) 
    json_ok = verify_json(json_path)

    success = csv_ok and db_ok and json_ok
    print(f"Verification: {'✓ All passed' if success else '✗ Some failed'}")

# Outputs
csv_path if RUN else None
db_path if RUN else None  
json_path if RUN else None
success if RUN else False
# ---------- end python_3_script ----------

panel = Panel("can you generate a frank lloyd write house in 3d using python grasshopper code? so i can visualize it in grasshopper")
# what is the WWR for the units with sda smaller than 30?
# return the units who have viewscores higher than .7?
# return all the panels with their unit id that have connected room as bedroom
file_path = FilePath("G:\My Drive\MACAD\AiAI_MODULE\STUDIO\data\knowledge_pool\merged.json")  # disabled
panel_2 = Panel(file_path)  # disabled
table_description_path = Data(python_3_script.json_path)  # disabled
db_path = Data(python_3_script.db_path)  # disabled
trigger = Trigger(Interval=1, TimerInterval=5, Target=python_3_script_2)  # disabled
number_slider = Slider(10, range=0..112)  # disabled
boolean_toggle_2 = BooleanToggle(True)  # disabled
toggle = BooleanToggle(False)  # disabled
python_3_script_2 = Python3Script()  # -> out, ai_response
# ---------- python_3_script_2: Python ----------
# GHPython (CPython in Rhino 8) or Python Script with requests available
import requests

ai_response = ""
user_input = ""
timestamp = ""
error = None

try:
    r = requests.get("http://127.0.0.1:5000/last", timeout=1)  # use 127.0.0.1, not localhost
    if r.ok:
        data = r.json()
        ai_response = data.get("ai_response", "")
        user_input  = data.get("user_input", "")
        timestamp   = data.get("timestamp", "")
    else:
        error = "HTTP {}".format(r.status_code)
except Exception as e:
    error = str(e)
# ---------- end python_3_script_2 ----------
python_3_script_3 = Python3Script(json_text=python_3_script_2.ai_response)  # -> out, Centers, Volumes, Names, Edges, Colors
# ---------- python_3_script_3: Python ----------
# Grasshopper Python (Rhino 7/8). Inputs: json_text
# Outputs: Volumes (Breps), Centers (Points), Names (Strings), Edges (Curves), Colors (System.Drawing.Color[])

import json, re, math
import Rhino.Geometry as rg
import System.Drawing as sd

# -------------------------
# Helpers: robust JSON parse
# -------------------------
def _strip_fences(s):
    return re.sub(r'^\s*```(?:json)?\s*|\s*```\s*$', '', s, flags=re.S)

def _extract_json(s):
    s = _strip_fences(s or "")
    start = s.find('{')
    if start < 0: raise ValueError("No '{' found")
    i = start; depth = 0; in_str = False; esc = False
    while i < len(s):
        ch = s[i]
        if in_str:
            if esc: esc = False
            elif ch == '\\': esc = True
            elif ch == '"': in_str = False
        else:
            if ch == '"': in_str = True
            elif ch == '{': depth += 1
            elif ch == '}':
                depth -= 1
                if depth == 0: return s[start:i+1]
        i += 1
    raise ValueError("Unbalanced braces")

def parse_json(text):
    js = _extract_json(text)
    return json.loads(js)

# -------------------------
# Geometry heuristics
# -------------------------
def type_params(room_type, name):
    t = (room_type or "").lower()
    n = (name or "").lower()
    min_w, aspect = 2.6, 1.4
    if "circulation" in t or "hall" in n: return 1.20, 3.0
    if "stair" in n:                     return 2.00, 1.2
    if "bath" in n or "wc" in n:         return 1.60, 1.1
    if "kitchen" in n:                   return 2.40, 1.5
    if "living" in n or "dining" in n:   return 3.50, 1.6
    if "bed" in n or "private" in t:     return 2.80, 1.3
    if "outdoor" in t or "terrace" in n: return 3.00, 2.0
    if "service" in t:                   return 2.40, 1.4
    if "public" in t:                    return 3.20, 1.5
    return min_w, aspect

def dims_from_area(area_m2, min_w, aspect):
    A = max(0.1, float(area_m2))
    w = math.sqrt(A * aspect)
    h = A / w
    if w < min_w:
        w = float(min_w); h = A / w
    ratio = w / max(0.001, h)
    if ratio < 0.55:
        w = math.sqrt(A * 0.55); h = A / w
    elif ratio > 2.5:
        w = math.sqrt(A * 2.5);  h = A / w
    return w, h

def rect_brep_centered(cx, cy, z, w, h, tol=1e-6):
    hw, hh = 0.5 * w, 0.5 * h
    pts = [
        rg.Point3d(cx - hw, cy - hh, z),
        rg.Point3d(cx + hw, cy - hh, z),
        rg.Point3d(cx + hw, cy + hh, z),
        rg.Point3d(cx - hw, cy + hh, z),
        rg.Point3d(cx - hw, cy - hh, z),
    ]
    crv = rg.Polyline(pts).ToNurbsCurve()
    breps = rg.Brep.CreatePlanarBreps(crv, tol)
    return (breps[0] if breps and len(breps) else None), crv

# -------------------------
# Sun orientation → color
# -------------------------
_BASE_DIRS = {
    'n': (0.0, 1.0),
    'e': (1.0, 0.0),
    's': (0.0,-1.0),
    'w': (-1.0,0.0)
}

def parse_sun_to_vector(s):
    """Parse 'south', 'south-east', 'SE', 'south-east' (unicode dash) → 2D unit vector. None if unknown."""
    if not s: return None
    t = s.lower()
    # normalize separators (space, _, -, en/em dashes, non-breaking hyphen)
    t = re.sub(u"[\\s_\\-\\u2010-\\u2015]+", " ", t)   # collapse to spaces
    t = t.replace("north", "n").replace("south", "s").replace("east", "e").replace("west", "w")
    t = t.replace("northeast","n e").replace("northwest","n w").replace("southeast","s e").replace("southwest","s w")
    parts = re.findall(r"[nsew]", t)
    if not parts: return None
    vx = sum(_BASE_DIRS[p][0] for p in parts)
    vy = sum(_BASE_DIRS[p][1] for p in parts)
    mag = math.hypot(vx, vy)
    if mag == 0: return None
    return (vx/mag, vy/mag)

def hsv_to_color(h_deg, s=0.85, v=0.95):
    """HSV (0-360, 0-1, 0-1) → System.Drawing.Color"""
    h = (h_deg % 360.0) / 60.0
    i = int(math.floor(h)) % 6
    f = h - math.floor(h)
    p = v * (1.0 - s)
    q = v * (1.0 - s * f)
    t = v * (1.0 - s * (1.0 - f))
    r,g,b = {
        0: (v,t,p),
        1: (q,v,p),
        2: (p,v,t),
        3: (p,q,v),
        4: (t,p,v),
        5: (v,p,q),
    }[i]
    return sd.Color.FromArgb(int(r*255), int(g*255), int(b*255))

def sun_to_color(s):
    """Map orientation to a hue. Default gray if unknown."""
    v = parse_sun_to_vector(s)
    if v is None:
        return sd.Color.FromArgb(200,200,200)
    # angle from +X axis (east). Hue wraps 0..360
    ang = math.degrees(math.atan2(v[1], v[0]))  # E=0°, N=90°, W=180°, S=-90°
    hue = (ang + 360.0) % 360.0
    return hsv_to_color(hue, s=0.85, v=0.95)

# -------------------------
# Main
# -------------------------
Volumes, Centers, Names, Edges, Colors = [], [], [], [], []

try:
    data = parse_json(json_text)
except Exception as e:
    ghenv.Component.AddRuntimeMessage(2, "JSON parse error: {}".format(e))
    data = None

if data:
    nodes = data.get("nodes", {})
    edges = data.get("edges", [])

    # Parameters
    floor_height = 3.2  # meters per floor
    z0 = 0.0            # ground datum
    centers_by_id = {}

    # 1) Create room rectangles + colors
    for rid, info in nodes.items():
        name  = info.get("name", rid)
        rtype = info.get("type", "")
        floor = int(info.get("floor", 0))
        cx, cy = info.get("coords", [0.0, 0.0])[:2]
        A      = float(info.get("area_m2", 12.0))
        sun    = info.get("sun", "")

        min_w, aspect = type_params(rtype, name)
        w, h = dims_from_area(A, min_w, aspect)
        z = z0 + floor * floor_height

        brep, _ = rect_brep_centered(cx, cy, z, w, h)
        if brep is None:
            ghenv.Component.AddRuntimeMessage(2, "Failed to build rectangle for '{}'".format(name))
            continue

        Volumes.append(brep)
        Centers.append(rg.Point3d(cx, cy, z))
        Names.append(name)
        centers_by_id[rid] = rg.Point3d(cx, cy, z)

        Colors.append(sun_to_color(sun))

    # 2) Relationship edges (center-to-center lines)
    for pair in edges:
        if not isinstance(pair, (list, tuple)) or len(pair) != 2:
            continue
        a, b = pair
        pa = centers_by_id.get(a)
        pb = centers_by_id.get(b)
        if pa and pb:
            Edges.append(rg.Line(pa, pb).ToNurbsCurve())

# Optional debug
# print("Rooms:", len(Volumes), "Edges:", len(Edges))
# ---------- end python_3_script_3 ----------
rectangle = Rectangle(Plane=PlaneXY(0, 0, 0), XSize=Slider(40, range=0..100), YSize=Slider(40, range=0..100), Radius=0)  # -> Rectangle, Length
py3 = Python3Script(db_path=db_path, table_descriptions_path=table_description_path, knowledge_pool_path=file_path, run=toggle)  # -> out, a, question_classification, response, unit_ids, panel_types; disabled
# ---------- py3: Python ----------
import requests
import re
from ghpythonlib.treehelpers import list_to_tree

url = 'http://localhost:5000/llm_call'
# print(f"Sending db_path: {db_path}")
payload = {
    'input': input_text,
    'db_path': db_path,
    'table_descriptions_path':table_descriptions_path,
    'knowledge_pool_path':knowledge_pool_path,
}
print(payload)


response = None
question_classification = None
json_data = None

if run:
    response = requests.post(url, json=payload)
    
    if response.status_code == 200:
        data = response.json()
        response = data['response']
        
        # Extract question classification from first json_values item
        if data['json_values'] and len(data['json_values']) > 0:
            first_item = data['json_values'][0]
            question_classification = first_item.get('question classification', 'unknown')
            json_data = data['json_values']
        
        # print(f"Response: {out}")
        # print(f"Classification: {question_classification}")
        print(f"Full data: {data}")
    else:
        out = "Failed to connect:"

print(response)
if isinstance(response, list):
    response = list_to_tree(response)



# def parse_output_string(response_string):
#     # Extract tuples using regex
#     pattern = r'\((\d+),\s*\'([^\']+)\'\)'
#     matches = re.findall(pattern, response_string)
    
#     # Convert to separate lists
#     unit_ids = [int(match[0]) for match in matches]
#     panel_types = [match[1] for match in matches]
    
#     return unit_ids, panel_types

# # Parse the response
# unit_ids, panel_types = parse_output_string(a)

# print(f"Unit IDs: {unit_ids[:5]}...")  # First 5
# print(f"Panel Types: {panel_types[:5]}...")  # First 5
# print(f"Total entries: {len(unit_ids)}")
# ---------- end py3 ----------
python_3_script_4 = Python3Script(run=Toggle(False), project_name="housesv0", input_text=panel, api_mode="local", model="gpt-oss-20b")  # -> out, response
# ---------- python_3_script_4: Python ----------
import requests
import re
from ghpythonlib.treehelpers import list_to_tree

url = 'http://localhost:5000/llm_call'
# print(f"Sending db_path: {db_path}")
payload = {
    'input_text': str(input_text),
    'api_mode': str(api_mode),
    'model': str(model),
    'project_name': str(project_name)
}

print(payload)


response = None
question_classification = None
json_data = None

if run:
    response = requests.post(url, json=payload)
    
    if response.status_code == 200:
        data = response.json()
        response = data['response']
        print(response)
        
        # # Extract question classification from first json_values item
        # if data['json_values'] and len(data['json_values']) > 0:
        #     first_item = data['json_values'][0]
        #     question_classification = first_item.get('question classification', 'unknown')
        #     json_data = data['json_values']
        
        # # print(f"Response: {out}")
        # # print(f"Classification: {question_classification}")
        # print(f"Full data: {data}")
    else:
        out = "Failed to connect:"
# ---------- end python_3_script_4 ----------
data_recorder = DataRecorder(python_3_script_2.ai_response, DataLimit=-10, RecordData=True)
brep = Brep(python_3_script_3.Volumes)
panel_3 = Panel(python_3_script_2.ai_response)
curve = Curve(python_3_script_3.Edges)
unit_z = UnitZ(Factor=Slider(2.8, range=0..10))
text_tag_3d = TextTag3D(Location=python_3_script_3.Centers, Text=python_3_script_3.Names, Size=Slider(0.6, range=0..1), Justification=7)
panel_4 = Panel(python_3_script_4.response)
circle = Circle(Plane=python_3_script_3.Centers, Radius=1)
extrude = Extrude(Base=brep, Direction=unit_z)
colour = Colour(python_3_script_3.Colors)
custom_preview = CustomPreview(Geometry=extrude, Material=colour)
python_3_script_5 = Python3Script()  # -> out, a, b, c, d
# ---------- python_3_script_5: Python ----------
import Rhino.Geometry as rg

# ----------------- Parameters -----------------
width, height = 12.0, 8.0          # footprint size (m)
core_w, core_h = 3.0, 4.0         # atrium / light shaft
roof_depth   = 0.8                 # over‑hang depth
building_ht  = 3.5                 # overall building height

# ----------------- Helpers ---------------------------------
def rect(x, y, w, h):
    """Return a planar rectangle as a NurbsCurve."""
    plane = rg.Plane(rg.Point3d(x + w/2, y + h/2, 0), rg.Vector3d.ZAxis)
    return rg.Rectangle3d(plane, w, h).ToNurbsCurve()

def extrude(curve):
    """Extrude a planar curve to a solid of height building_ht."""
    vec = rg.Vector3d(0, 0, building_ht)
    return rg.Extrusion.Create(curve, building_ht, True)

# ----------------- Footprint ---------------------------------
footprint_curve = rect(0, 0, width, height)

# ----------------- Atrium (light shaft) ----------------------
core_x = (width - core_w)/2
core_y = (height - core_h)/2
atrium_curve = rect(core_x, core_y, core_w, core_h)
atrium_solid = extrude(atrium_curve)

# ----------------- Rooms ------------------------------------
rooms = []

# 1. Living / Dining (left side of atrium)
left_w = (width - core_w)/2
rooms.append(extrude(rect(0, 0, left_w, height)))

# 2. Bedroom / Office (right side of atrium)
rooms.append(extrude(rect(width-left_w, 0, left_w, height)))

# 3. Kitchen (back of atrium)
kitchen_h = 2.5
rooms.append(extrude(rect(core_x, height-kitchen_h, core_w, kitchen_h)))

# 4. Bathroom (adjacent to kitchen, 1 m wide)
bathroom_w = 1.0
rooms.append(extrude(rect(core_x+core_w/2-bathroom_w/2,
                          height-kitchen_h-1.5,
                          bathroom_w, 1.5)))

# 5. Storage / Utility (corner of left room, 1 m wide)
storage_w = 1.0
rooms.append(extrude(rect(0, height-1.5, storage_w, 1.5)))

# ----------------- Roof over‑hang ----------------------------
roof_pts = [
    rg.Point3d(0,          roof_depth, 0),
    rg.Point3d(width,      roof_depth, 0),
    rg.Point3d(width,      -roof_depth, 0),
    rg.Point3d(0,          -roof_depth, 0)
]
roof_curve = rg.PolylineCurve(roof_pts)
roof_surf  = rg.Surface.CreateExtrusion(roof_curve,
                                        rg.Vector3d(0,0,building_ht))

# ----------------- Outputs -----------------------------------
a = footprint_curve   # plan view (optional preview)
b = atrium_solid      # solid atrium
c = rooms             # list of all room solids
d = roof_surf         # roof surface
# ---------- end python_3_script_5 ----------
python_3_script_6 = Python3Script()  # -> out, a, b, c, d
# ---------- python_3_script_6: Python ----------
import Rhino.Geometry as rg

# ----------------- Parameters -----------------
width, height = 12.0, 8.0          # footprint size (m)
core_w, core_h = 3.0, 4.0         # atrium size
roof_depth   = 0.8                 # over‑hang depth
building_ht  = 3.5                 # overall building height

# ----------------- Helper ---------------------------------
def rect(x, y, w, h):
    """Return a planar rectangle as a NurbsCurve."""
    plane = rg.Plane(rg.Point3d(x + w/2, y + h/2, 0), rg.Vector3d.ZAxis)
    return rg.Rectangle3d(plane, w, h).ToNurbsCurve()

def extrude(curve, ht):
    """Extrude a planar curve to a solid."""
    plane = rg.Plane.WorldXY
    vec   = rg.Vector3d(0, 0, ht)
    return rg.Extrusion.Create(curve, ht, True)

# ----------------- Footprint ---------------------------------
footprint_curve = rect(0, 0, width, height)

# ----------------- Atrium (light shaft) ----------------------
core_x = (width - core_w)/2
core_y = (height - core_h)/2
atrium_curve = rect(core_x, core_y, core_w, core_h)
atrium_solid = extrude(atrium_curve, building_ht)

# ----------------- Rooms ------------------------------------
rooms = []

# Left side room
left_w  = (width - core_w)/2
rooms.append(extrude(rect(0, 0, left_w, height), building_ht))

# Right side room
rooms.append(extrude(rect(width-left_w, 0, left_w, height), building_ht))

# Kitchen at back of atrium
kitchen_h = 2.5
rooms.append(extrude(rect(core_x, height-kitchen_h, core_w, kitchen_h),
                     building_ht))

# ----------------- Roof over‑hang ----------------------------
roof_pts = [
    rg.Point3d(0,          roof_depth, 0),
    rg.Point3d(width,      roof_depth, 0),
    rg.Point3d(width,      -roof_depth, 0),
    rg.Point3d(0,          -roof_depth, 0)
]
roof_curve = rg.PolylineCurve(roof_pts)
roof_surf  = rg.Surface.CreateExtrusion(roof_curve, rg.Vector3d(0,0,building_ht))

# ----------------- Outputs -----------------------------------
a = footprint_curve   # plan view
b = atrium_solid      # solid atrium
c = rooms             # list of room solids
d = roof_surf         # roof surface
# ---------- end python_3_script_6 ----------
python_3_script_7 = Python3Script()  # -> out, a, b, c, d
# ---------- python_3_script_7: Python ----------
# ──────────────────────────────────────────────────────────────
# Parameters – change these to regenerate the model
footprint_len = 12.0          # m
footprint_wid = 8.0           # m
room_h        = 3.5            # m
atrium_w, atrium_d = 3.0, 4.0 # m (width × depth)
roof_overhang   = 0.8         # m
roof_pitch      = 0.05        # rise/run

# ──────────────────────────────────────────────────────────────
import Rhino.Geometry as rg

def rect_brep(x, y):
    """Return a rectangular Brep in the XY plane centred at origin."""
    return rg.Brep.CreateFromBox(
        rg.Box(rg.Plane.WorldXY,
               rg.Interval(-x/2.0, x/2.0),
               rg.Interval(-y/2.0, y/2.0),
               rg.Interval(0, 1)))   # unit height; we will scale later

# 1. Base footprint (extruded to room height)
base_extrude = rg.Brep.CreateFromBox(
    rg.Box(rg.Plane.WorldXY,
           rg.Interval(-footprint_len/2.0, footprint_len/2.0),
           rg.Interval(-footprint_wid/2.0, footprint_wid/2.0),
           rg.Interval(0, room_h))
)

# 2. Central atrium (cut through the base)
atrium_extrude = rg.Brep.CreateFromBox(
    rg.Box(rg.Plane.WorldXY,
           rg.Interval(-atrium_w/2.0, atrium_w/2.0),
           rg.Interval(-atrium_d/2.0, atrium_d/2.0),
           rg.Interval(0, room_h))
)

# 3. Subtract atrium from base
house = rg.Brep.CreateBooleanDifference(base_extrude, atrium_extrude, 0.01)[0]

# 4. Roof – a shallow overhang with slight pitch
roof_height = room_h + roof_pitch    # total height of the roof box
roof_brep = rg.Brep.CreateFromBox(
    rg.Box(rg.Plane.WorldXY,
           rg.Interval(-(footprint_len/2.0 + roof_overhang),
                       footprint_len/2.0 + roof_overhang),
           rg.Interval(-(footprint_wid/2.0 + roof_overhang),
                       footprint_wid/2.0 + roof_overhang),
           rg.Interval(room_h, roof_height))
)

# 5. Union everything
final = rg.Brep.CreateBooleanUnion([house, roof_brep], 0.01)[0]

# ──────────────────────────────────────────────────────────────
# Output the final Brep to Grasshopper
a = final   # 'a' is the output variable in ghPython
# ---------- end python_3_script_7 ----------
python_3_script_8 = Python3Script()  # -> out, a, b, c, d
# ---------- python_3_script_8: Python ----------
# Parameters – edit these to regenerate the model
room_w   = 4.0          # width of one room (m)
room_d   = 5.0          # depth of one room (m)
room_h   = 3.0          # height of each room (m)

n_rooms  = 4            # number of rooms in the long direction
overhang = 0.8          # roof over‑hang (m)
pitch    = 0.05         # rise/run ratio

import Rhino.Geometry as rg

# Helper: create a single room box and translate it to its position
def make_room(index):
    b = rg.Brep.CreateFromBox(
        rg.Box(rg.Plane.WorldXY,
               rg.Interval(-room_w/2.0,  room_w/2.0),
               rg.Interval(-room_d/2.0,  room_d/2.0),
               rg.Interval(0,          room_h)))
    # move it along X so rooms line up
    t = rg.Transform.Translation(rg.Vector3d(index * room_w, 0, 0))
    b.Transform(t)
    return b

# Build all rooms and union them into one solid body
rooms   = [make_room(i) for i in range(n_rooms)]
body    = rg.Brep.CreateBooleanUnion(rooms, 0.01)[0]

# Roof – a single box that sits on top of the whole building
roof_top = room_h + pitch * (room_w  * n_rooms)
roof_box = rg.Brep.CreateFromBox(
    rg.Box(rg.Plane.WorldXY,
           rg.Interval(-(room_w*n_rooms/2.0 + overhang),
                       room_w*n_rooms/2.0 + overhang),
           rg.Interval(-room_d/2.0 - overhang,
                       room_d/2.0 + overhang),
           rg.Interval(room_h, roof_top)))

# Union body + roof
final = rg.Brep.CreateBooleanUnion([body, roof_box], 0.01)[0]

# Output the final Brep to Grasshopper
a = final   # 'a' is the output variable in ghPython
# ---------- end python_3_script_8 ----------
python_3_script_9 = Python3Script()  # -> out, a
# ---------- python_3_script_9: Python ----------
# GH-Python – Rhino/Grasshopper
import rhinoscriptsyntax as rs

# ---------- Parameters ----------
w, d = 30.0, 20.0          # footprint size
h_main, h_sec = 6.0, 4.0    # heights of main and secondary volumes
overhang = 1.5              # roof over‑hang height
n_volumes = 3               # number of stacked blocks

# ---------- Helper: create a box ----------
def make_box(x, y, bw, bd, bh):
    pts = [rs.CreatePoint(x, y, 0),
           rs.CreatePoint(x+bw, y, 0),
           rs.CreatePoint(x+bw, y+bd, 0),
           rs.CreatePoint(x, y+bd, 0)]
    base = rs.AddPolyline(pts + [pts[0]])
    return rs.ExtrudeCurveStraight(base, (0,0,0), (0,0,bh))

# ---------- Build stacked volumes ----------
volumes = []
z = 0
for i in range(n_volumes):
    bw = w *(1 - 0.05* i)          # taper width
    bd = d  *(1 - 0.07* i)          # taper depth
    bh = h_main if i == 0 else h_sec
    vol = make_box((w-bw)/2, (d-bd)/2, bw, bd, bh)
    rs.MoveObject(vol, (0,0,z))
    volumes.append(vol)
    z += bh

# ---------- Roof ----------
roof_pts = [rs.CreatePoint(0, 0, z+overhang),
            rs.CreatePoint(w, 0, z+overhang),
            rs.CreatePoint(w, d, z+overhang),
            rs.CreatePoint(0, d, z+overhang)]
roof = rs.AddPolyline(roof_pts + [roof_pts[0]])

# ---------- Output ----------
a = volumes + [roof]   # 'a' is the default output variable
# ---------- end python_3_script_9 ----------
brep_2 = Brep(python_3_script_6.b)
brep_3 = Brep(python_3_script_5.b)
brep_4 = Brep(python_3_script_6.a)
brep_5 = Brep(python_3_script_6.c)
brep_6 = Brep(python_3_script_7.b)
brep_7 = Brep(python_3_script_8.b)
brep_8 = Brep(python_3_script_5.a)
brep_9 = Brep(python_3_script_5.c)
brep_10 = Brep(python_3_script_7.a)
brep_11 = Brep(python_3_script_8.a)
brep_12 = Brep(python_3_script_7.c)
brep_13 = Brep(python_3_script_8.c)
