# Grasshopper definition PlotGeneration.gh (Grasshopper 1.0.8)
# plug-ins: CORE.Toolbox.Grasshopper, Pufferfish, Human

panel = Panel("""south
north
east
west""")
list_length = ListLength(List=panel)
number_slider = Slider(3, range=0..1000)
construct_domain = ConstructDomain(DomainStart=0, DomainEnd=list_length)
random = Random(Range=construct_domain, Number=1, Seed=number_slider)
round = Round(Number=random)  # -> Nearest, Floor, Ceiling
list_item = ListItem(List=panel, Index=round.Floor, Wrap=True)

# ---- group: Generate PLOT
python_3_script = Python3Script(
    seed=number_slider,
    sides_min=Slider(4, range=0..10),
    sides_max=Slider(6, range=0..10),
    tree_clusters=Slider(6, range=0..10),
    ROAD_FILLET_RADIUS=Slider(2, range=0..10),
    ROAD_MIN_SEG_LEN=Slider(2, range=0..10),
    entrance_side=list_item)  # -> out, site_boundaries, buildable_zones, water_features, tree_zones, access_roads, site_info; inputs seed: Int32, ROAD_FILLET_RADIUS: Int32, ROAD_MIN_SEG_LEN: Int32
# ---------- python_3_script: Python ----------
"""
Single Lot Generator — straightforward + robust
- Pad never overlaps trees or ponds (uses buffered pond & clearance tests)
- Road is a simple Polyline (few legs, no tiny segments, no hooks into pad)
- Pad size: control with GH sliders named `pad_area` (m2) and `pad_aspect` (W/H)
"""

import Rhino
import Rhino.Geometry as rg
import math, random, heapq

# ===================== Inputs / Defaults =====================
site_boundaries, buildable_zones, water_features, tree_zones, access_roads, site_info = [], [], [], [], [], []

seed = 42 if 'seed' not in globals() or seed is None else int(seed)
one_per_lot = True if 'one_per_lot' not in globals() or one_per_lot is None else bool(one_per_lot)
entrance_side = ("south" if 'entrance_side' not in globals() or entrance_side not in ("south","north","east","west") else entrance_side)
lot_type = "XL" if 'lot_type' not in globals() or lot_type not in ("Large","XL") else lot_type

sides_min = 7 if 'sides_min' not in globals() or sides_min is None else int(sides_min)
sides_max = 10 if 'sides_max' not in globals() or sides_max is None else int(sides_max)
tree_clusters = 4 if 'tree_clusters' not in globals() or tree_clusters is None else int(tree_clusters)

# clearances (meters)
pad_setback     = 10.0 if 'pad_setback'     not in globals() or pad_setback     is None else float(pad_setback)
pad_tree_clear  = 2.0  if 'pad_tree_clear'  not in globals() or pad_tree_clear  is None else float(pad_tree_clear)
pad_water_clear = 5.0  if 'pad_water_clear' not in globals() or pad_water_clear is None else float(pad_water_clear)
tree_water_clear= 0.3  if 'tree_water_clear'not in globals() or tree_water_clear is None else float(tree_water_clear)

pond_radius   = 15.0 if 'pond_radius'   not in globals() or pond_radius   is None else float(pond_radius)
pond_points   = 48   if 'pond_points'   not in globals() or pond_points   is None else int(pond_points)
pond_noise    = 0.22 if 'pond_noise'    not in globals() or pond_noise    is None else float(pond_noise)
pond_lobes_min= 2    if 'pond_lobes_min'not in globals() or pond_lobes_min is None else int(pond_lobes_min)
pond_lobes_max= 4    if 'pond_lobes_max'not in globals() or pond_lobes_max is None else int(pond_lobes_max)

# ========================= Tunables ==========================
TOL=1e-3

# road shaping
ROAD_STEP_DEFAULT=6.0     # A* grid step (fallback)
ROAD_CLEAR=2.5            # clearance to trees/water
ROAD_MIN_SEG_LEN=4.5      # remove shorter legs
MIN_BEND_KEEP_DEG=95.0    # delete bends sharper than this when safe
APPROACH_LEAD_IN=8.0      # last leg goes straight out of pad for this distance
TURN_PENALTY=0.50         # discourages zigzags in A*

MAX_SITE_RETRIES=2

# pad search grid density
GRID_DENSITY_MULT=1.25
PAD_SOFTEN_STEPS=(0.0,0.4,0.8)
MIN_PAD_SCALE=0.70

# lot presets (only size is used here)
LOT_SIZES={"Large":{"width":100,"depth":100,"building_size":30},
           "XL":   {"width":150,"depth":120,"building_size":40}}

# --- Pad size (from GH sliders "pad_area", "pad_aspect") ---
_default_w = LOT_SIZES[lot_type]["building_size"]; _default_h = _default_w*0.8
_default_area   = _default_w*_default_h
_default_aspect = _default_w/_default_h
pad_area   = _default_area   if 'pad_area'   not in globals() or pad_area   is None else float(pad_area)
pad_aspect = _default_aspect if 'pad_aspect' not in globals() or pad_aspect is None else float(pad_aspect)
PAD_W = math.sqrt(max(1.0,pad_area) * max(0.2, pad_aspect))
PAD_H = max(1.0, pad_area / PAD_W)

# ======================== Small helpers ======================
def _ok(c):
    try: return c is not None and c.IsValid
    except: return False

def _contains(crv, pt, tol=TOL):
    if not _ok(crv): return False
    try: rc = crv.Contains(pt, rg.Plane.WorldXY, tol)
    except TypeError: rc = crv.Contains(pt)
    return rc in (rg.PointContainment.Inside, rg.PointContainment.Coincident)

def _min_dist_pt_crv(pt, crv):
    if not _ok(crv): return float('inf')
    try:
        ok,t=crv.ClosestPoint(pt)
        return pt.DistanceTo(crv.PointAt(t)) if ok else float('inf')
    except: return float('inf')

def _curves_intersect(a, b, tol=TOL):
    try:
        ccx = Rhino.Geometry.Intersect.Intersection.CurveCurve(a, b, tol, tol)
        return bool(ccx and ccx.Count > 0)
    except: return False

def _closed_disjoint(a_closed, b_closed, tol=TOL):
    try:
        rel = rg.Curve.PlanarClosedCurveRelationship(a_closed, b_closed, rg.Plane.WorldXY, tol)
        return rel == rg.RegionContainment.Disjoint
    except: return not _curves_intersect(a_closed, b_closed, tol)

def _tree_radius_center(tree):
    try:
        ok,c = tree.TryGetCircle()
        if ok: return c.Radius, c.Center
    except: pass
    bb = tree.GetBoundingBox(True)
    return 0.5*max(bb.Max.X-bb.Min.X, bb.Max.Y-bb.Min.Y), bb.Center

def _centroid(closed):
    if not _ok(closed): return rg.Point3d(0,0,0)
    try:
        amp=rg.AreaMassProperties.Compute(closed)
        return amp.Centroid if amp else closed.GetBoundingBox(True).Center
    except: return closed.GetBoundingBox(True).Center

def _rect(center,w,h,ang):
    hw,hh=0.5*w,0.5*h
    pts=[rg.Point3d(-hw,-hh,0), rg.Point3d(hw,-hh,0), rg.Point3d(hw,hh,0), rg.Point3d(-hw,hh,0), rg.Point3d(-hw,-hh,0)]
    crv=rg.PolylineCurve(pts)
    R=rg.Transform.Rotation(ang, rg.Vector3d(0,0,1), rg.Point3d(0,0,0))
    T=rg.Transform.Translation(center - rg.Point3d(0,0,0))
    crv.Transform(R); crv.Transform(T)
    return crv

def _inward_offset(crv, d):
    if not _ok(crv) or d<=0: return crv
    try:
        offs=crv.Offset(rg.Plane.WorldXY, -abs(float(d)), TOL, rg.CurveOffsetCornerStyle.Sharp) or []
        best=None; bestA=-1.0
        for c in offs:
            if not _ok(c) or not c.IsClosed: continue
            A=(rg.AreaMassProperties.Compute(c).Area if rg.AreaMassProperties.Compute(c) else 0.0)
            if A>bestA and _contains(crv, c.GetBoundingBox(True).Center): best,bestA=c,A
        return best
    except: return None

def _angle_deg(u,v):
    uu=rg.Vector3d(u); vv=rg.Vector3d(v)
    if uu.IsTiny() or vv.IsTiny(): return 0.0
    uu.Unitize(); vv.Unitize()
    d=max(-1.0,min(1.0,rg.Vector3d.Multiply(uu,vv)))
    return math.degrees(math.acos(d))

def _curve_min_dist(a, b, sa=48, sb=48):
    if not (_ok(a) and _ok(b)): return float('inf')
    m=float('inf')
    for i in range(max(2, sa)):
        p=a.PointAtNormalizedLength(float(i)/(sa-1))
        m=min(m,_min_dist_pt_crv(p,b))
    for j in range(max(2, sb)):
        q=b.PointAtNormalizedLength(float(j)/(sb-1))
        m=min(m,_min_dist_pt_crv(q,a))
    return m

def _buffer_closed(closed, d):
    """Outward buffer for closed curve (choose largest-area offset > original)."""
    if not (_ok(closed) and d>0): return None
    try: A0=(rg.AreaMassProperties.Compute(closed).Area or 0.0)
    except: A0=0.0
    offs=(closed.Offset(rg.Plane.WorldXY, d, TOL, rg.CurveOffsetCornerStyle.Round) or [])
    best, bestA=None, -1.0
    for c in offs:
        if not (_ok(c) and c.IsClosed): continue
        try: A=rg.AreaMassProperties.Compute(c).Area
        except: A=-1.0
        if A>A0 and A>bestA: best, bestA=c, A
    return best

# ======================= Lot primitives ======================
def create_organic_boundary(w,d,cx=0,cy=0):
    n=random.randint(sides_min, sides_max); pts=[]
    for i in range(n):
        a=(2*math.pi*i/n)+random.uniform(-0.18,0.18)
        r0=(w+d)/4.0; r=r0+random.uniform(-0.25*r0,0.25*r0)
        pts.append(rg.Point3d(cx+w/2.0 + r*math.cos(a), cy+d/2.0 + r*math.sin(a),0))
    pts.append(pts[0]); return rg.PolylineCurve(pts)

def make_organic_blob(center, base_r, pts, ampl, lobes_min, lobes_max):
    comps=[(random.randint(lobes_min,lobes_max), random.uniform(0,2*math.pi), random.uniform(0.35,1.0))
           for _ in range(random.randint(2,3))]
    cx,cy=center.X,center.Y; P=[]
    for i in range(pts):
        t=2*math.pi*i/float(pts); k=1.0
        for f,ph,w in comps: k += ampl*w*math.sin(f*t+ph)
        r=max(0.2*base_r, base_r*k)
        P.append(rg.Point3d(cx+r*math.cos(t), cy+r*math.sin(t),0))
    try:
        crv=rg.NurbsCurve.CreateThroughPoints(P,3,True)
        if crv and crv.IsClosed: return crv
    except: pass
    P.append(P[0]); crv=rg.Curve.CreateInterpolatedCurve(P,3)
    if not crv.IsClosed: crv.MakeClosed(TOL)
    return crv

def add_water_feature(boundary, must_have_pond=True):
    features=[]; bb=boundary.GetBoundingBox(True); placed=False
    for _ in range(40):
        x=random.uniform(bb.Min.X+18, bb.Max.X-18); y=random.uniform(bb.Min.Y+18, bb.Max.Y-18)
        c=rg.Point3d(x,y,0)
        if not _contains(boundary,c): continue
        pond=make_organic_blob(c, pond_radius, pond_points, pond_noise, pond_lobes_min, pond_lobes_max)
        if _ok(pond) and pond.IsClosed: 
            # keep fully inside lot
            ok=True
            for k in range(36):
                p=pond.PointAtNormalizedLength(float(k)/35.0)
                if not _contains(boundary,p): ok=False; break
            if ok: features.append(pond); placed=True; break
    if must_have_pond and not placed:
        c=_centroid(boundary); features.append(rg.Circle(c, pond_radius).ToNurbsCurve())
    return [f for f in features if _ok(f)]

def add_trees(boundary, density, waters):
    trees=[]; positions=[]; bb=boundary.GetBoundingBox(True)
    waters=[w for w in (waters or []) if _ok(w)]
    def hits_water(center,r):
        for w in waters:
            if w.IsClosed:
                for a in [2*math.pi*k/12.0 for k in range(12)]:
                    p=rg.Point3d(center.X+(r+1e-6)*math.cos(a), center.Y+(r+1e-6)*math.sin(a),0)
                    if _contains(w,p) or _min_dist_pt_crv(p,w)<1e-3: return True
            else:
                if _min_dist_pt_crv(center,w) < r + tree_water_clear: return True
        return False
    for _ in range(max(0,int(density))):
        for _try in range(20):
            x=random.uniform(bb.Min.X+6, bb.Max.X-6); y=random.uniform(bb.Min.Y+6, bb.Max.Y-6)
            c=rg.Point3d(x,y,0)
            if _contains(boundary,c) and not hits_water(c,0.0): break
        else: continue
        for _n in range(random.randint(3,5)):
            for _try in range(20):
                tx=x+random.uniform(-7,7); ty=y+random.uniform(-7,7); r=random.uniform(2,4)
                p=rg.Point3d(tx,ty,0)
                if not _contains(boundary,p): continue
                if any(p.DistanceTo(ep)<(r+er+1.0) for ep,er in positions): continue
                if hits_water(p,r): continue
                trees.append(rg.Circle(p,r).ToNurbsCurve()); positions.append((p,r)); break
    return trees

# ==================== Pad placement (robust) =================
def boundary_touch_points(boundary, side="south", inset=0.5):
    bb=boundary.GetBoundingBox(True); cx=0.5*(bb.Min.X+bb.Max.X); cy=0.5*(bb.Min.Y+bb.Max.Y)
    anchor = (rg.Point3d(cx,bb.Min.Y-20,0) if side=="south" else
              rg.Point3d(cx,bb.Max.Y+20,0) if side=="north" else
              rg.Point3d(bb.Min.X-20,cy,0) if side=="west"  else
              rg.Point3d(bb.Max.X+20,cy,0))
    ok,t=boundary.ClosestPoint(anchor); t=t if ok else boundary.Domain.T0
    touch=boundary.PointAt(t); cen=_centroid(boundary)
    v=rg.Vector3d(cen.X-touch.X, cen.Y-touch.Y,0); v=rg.Vector3d(0,1,0) if v.IsTiny() else v; v.Unitize()
    return touch, rg.Point3d(touch.X+v.X*max(0.1,inset), touch.Y+v.Y*max(0.1,inset),0)

def _pad_is_clear(rect, trees, waters, tc, wc):
    """Pad valid iff no overlap with trees and disjoint from pond buffered by wc; also min wc to all water."""
    if not _ok(rect): return False
    trees=[t for t in (trees or []) if _ok(t)]; waters=[w for w in (waters or []) if _ok(w)]
    # Trees
    for t in trees:
        r,c=_tree_radius_center(t)
        if _contains(rect, c): return False
        if _min_dist_pt_crv(c, rect) < (r+tc-1e-6): return False
        if _curves_intersect(rect, t): return False
    # Water
    for w in waters:
        if _curves_intersect(rect, w): return False
        if w.IsClosed:
            buf=_buffer_closed(w, wc)
            if buf and not _closed_disjoint(rect, buf): return False
            try:
                rel=rg.Curve.PlanarClosedCurveRelationship(rect, w, rg.Plane.WorldXY, TOL)
                if rel != rg.RegionContainment.Disjoint: return False
            except:
                # fallback: sample rect on pond test
                for k in range(32):
                    p=rect.PointAtNormalizedLength(float(k)/31.0)
                    if _contains(w,p): return False
        if _curve_min_dist(rect, w) < (wc-1e-6): return False
    return True

def _rect_clear(rect, trees, waters, tc, wc, samples=96):
    """Return True if the rectangular pad is clear of trees and water.
       - No tree center inside pad
       - Distance from pad to each tree >= r + tc
       - No pad-water intersections
       - For closed ponds: regions must be disjoint
       - Clearance to any water (closed/open) >= wc
    """
    if not _ok(rect): return False
    trees  = [t for t in (trees  or []) if _ok(t)]
    waters = [w for w in (waters or []) if _ok(w)]

    # perimeter points for robust inside checks (also hits corners)
    ring = [rect.PointAtNormalizedLength(float(i)/(max(2, samples)-1)) for i in range(max(2, samples))]

    # ---- Trees ----
    for t in trees:
        r, c = _tree_radius_center(t)
        if _contains(rect, c):                      # tree center inside pad
            return False
        if _min_dist_pt_crv(c, rect) < r + tc - 1e-6:
            return False
        try:
            ccx = Rhino.Geometry.Intersect.Intersection.CurveCurve(rect, t, TOL, TOL)
            if ccx and ccx.Count > 0:               # paranoid guard
                return False
        except: 
            pass

    # ---- Water ----
    for w in waters:
        try:
            ccx = Rhino.Geometry.Intersect.Intersection.CurveCurve(rect, w, TOL, TOL)
            if ccx and ccx.Count > 0:               # no geometric crossings
                return False
        except:
            pass

        if w.IsClosed:
            # strict region-disjoint with pond
            try:
                rel = rg.Curve.PlanarClosedCurveRelationship(rect, w, rg.Plane.WorldXY, TOL)
                if rel != rg.RegionContainment.Disjoint:
                    return False
            except:
                # fallback: any pad-perimeter point inside pond?
                if any(_contains(w, p) for p in ring):
                    return False

        # numeric clearance to any water (closed or open)
        if _curve_min_dist(rect, w, samples, samples) < wc - 1e-6:
            return False

    return True


def _pad_is_clear(rect, trees, waters, tc, wc, samples=96):
    # simple alias so place_pads can call one function
    return _rect_clear(rect, trees, waters, tc, wc, samples)


# (Only if you DON'T already have this in your file, add it too.)
def _curve_inside(boundary, crv, samples=64):
    if not (_ok(boundary) and _ok(crv)): return False
    for i in range(samples):
        p = crv.PointAtNormalizedLength(float(i)/max(1, samples-1))
        if not _contains(boundary, p): 
            return False
    return True

# --- replace your place_pads with this version ---
def place_pads(boundary, size_info, trees, waters, one_per=True):
    if not _ok(boundary): return []

    # size from sliders (with optional overrides)
    default_area = (size_info.get("building_size", 40.0)**2) * 0.8
    A  = float(globals().get('pad_area',   default_area))
    AR = float(globals().get('pad_aspect', 1.25))
    W  = max(2.0, math.sqrt(max(1.0, A)*AR))
    H  = max(2.0, A/W)
    W  = float(globals().get('pad_width',  W))
    H  = float(globals().get('pad_height', H))
    angs = [0.0, math.pi*0.5]
    rdeg = float(globals().get('pad_rotation', 0.0))
    if abs(rdeg) > 1e-9: angs.append(math.radians(rdeg))

    # envelope with setback (fallback to boundary if offset fails)
    env = _inward_offset(boundary, pad_setback) or _inward_offset(boundary, 0.5*pad_setback) or boundary

    bb = env.GetBoundingBox(True); m = 6.0
    sx = max(0.1, bb.Max.X - bb.Min.X - 2*m)
    sy = max(0.1, bb.Max.Y - bb.Min.Y - 2*m)
    nx = max(6, int((sx / max(6.0, W*0.6)) * GRID_DENSITY_MULT))
    ny = max(6, int((sy / max(6.0, H*0.6)) * GRID_DENSITY_MULT))
    xs = [bb.Min.X + m + i*(sx/max(1, nx-1)) for i in range(nx)]
    ys = [bb.Min.Y + m + j*(sy/max(1, ny-1)) for j in range(ny)]

    # driveway bias
    _, entry_in = boundary_touch_points(boundary, entrance_side, 0.5)
    def _dpt(pt, crv):
        try:
            ok,t = crv.ClosestPoint(pt)
            return pt.DistanceTo(crv.PointAt(t)) if ok else 1e9
        except: return 1e9
    def pond_bonus(pt):
        if not waters: return 0.0
        d = min(_dpt(pt, w) for w in waters if _ok(w))
        return max(0.0, 1.0 - abs(d - 30.0)/25.0)

    best=None; bestS=-1e9
    for soften in PAD_SOFTEN_STEPS:
        tc = max(0.0, pad_tree_clear  - soften)
        wc = max(0.0, pad_water_clear - soften)
        found=False
        for s in (1.0, 0.9, 0.8, MIN_PAD_SCALE):
            w, h = W*s, H*s
            for x in xs:
                for y in ys:
                    p = rg.Point3d(x, y, 0)
                    if not _contains(env, p): continue
                    for a in angs:
                        r = _rect(p, w, h, a)
                        # must be fully inside setback envelope
                        if not _curve_inside(env, r, samples=64): continue
                        # must be clear of trees & water (with clearances)
                        if not _pad_is_clear(r, trees, waters, tc, wc): continue
                        c  = r.GetBoundingBox(True).Center
                        sc = -rg.Point3d(c.X, c.Y, 0).DistanceTo(entry_in)*0.05 + pond_bonus(rg.Point3d(c.X,c.Y,0))*0.5
                        if sc > bestS: best, bestS, found = r, sc, True
            if found: break
        if found: break

    # robust fallback: shrink at env center until it fits & is clear
    if not best:
        c = env.GetBoundingBox(True).Center
        for s in (0.85, 0.75, 0.65, 0.55):
            r = _rect(rg.Point3d(c.X, c.Y, 0), W*s, H*s, 0.0)
            if _curve_inside(env, r, samples=64) and _pad_is_clear(r, trees, waters, pad_tree_clear, pad_water_clear):
                best = r; break

    # final safety: pad must be fully inside the lot boundary
    if best and not _curve_inside(boundary, best, samples=64):
        best = None

    return [best] if best else []

def place_building_zones(boundary, size_info, trees, waters, one_per=True):
    return place_pads(boundary, size_info, trees, waters, one_per)

# ===================== Road (simple polyline) =================
def _edge_mid_and_normal(pad_rect, prefer_from):
    bb=pad_rect.GetBoundingBox(True)
    crn=[rg.Point3d(bb.Min.X,bb.Min.Y,0), rg.Point3d(bb.Max.X,bb.Min.Y,0),
         rg.Point3d(bb.Max.X,bb.Max.Y,0), rg.Point3d(bb.Min.X,bb.Max.Y,0)]
    mids=[]; norms=[]; c=bb.Center
    for i in range(4):
        a,b=crn[i], crn[(i+1)%4]; m=rg.Point3d((a.X+b.X)*.5,(a.Y+b.Y)*.5,0)
        n=rg.Vector3d(m.X-c.X, m.Y-c.Y, 0)
        if not n.IsTiny(): n.Unitize()
        mids.append(m); norms.append(n)
    d=rg.Vector3d(prefer_from.X-c.X, prefer_from.Y-c.Y,0)
    if not d.IsTiny(): d.Unitize()
    idx=max(range(4), key=lambda k: rg.Vector3d.Multiply(norms[k], d))
    return mids[idx], norms[idx]

def _goal_points(pad_rect, from_pt, apron_out=0.7, lead=APPROACH_LEAD_IN):
    mid,n=_edge_mid_and_normal(pad_rect, from_pt)
    goal=rg.Point3d(mid.X+n.X*max(0.25,apron_out), mid.Y+n.Y*max(0.25,apron_out),0)
    pre =rg.Point3d(goal.X+n.X*lead, goal.Y+n.Y*lead,0)
    return goal, pre, n

def _segment_clear(a,b,boundary,trees,waters,clear,pads=None):
    trees=[t for t in (trees or []) if _ok(t)]
    waters=[w for w in (waters or []) if _ok(w)]
    pads=[p for p in (pads or []) if _ok(p)]
    # parametric sampling + intersection checks
    S=12
    for i in range(S+1):
        t=float(i)/S; p=rg.Point3d(a.X+(b.X-a.X)*t, a.Y+(b.Y-a.Y)*t, 0)
        if not _contains(boundary,p): return False
        if any(_contains(P,p) for P in pads): return False
        for tr in trees:
            r,c=_tree_radius_center(tr)
            if p.DistanceTo(c) < r+clear-1e-6: return False
        if any(_min_dist_pt_crv(p,w) < clear-1e-6 for w in waters): return False
    seg=rg.PolylineCurve([a,b])
    if any(_curves_intersect(seg,w) for w in waters): return False
    if any(_curves_intersect(seg,P) for P in pads):   return False
    return True

def _drop_kinks(P, boundary, trees, waters, clear, pad=None, min_keep_deg=MIN_BEND_KEEP_DEG, passes=3):
    if len(P)<3: return list(P)
    for _ in range(passes):
        changed=False; Q=[P[0]]
        for i in range(1,len(P)-1):
            a,b,c=Q[-1], P[i], P[i+1]
            ang=_angle_deg(rg.Vector3d(b.X-a.X,b.Y-a.Y,0), rg.Vector3d(c.X-b.X,c.Y-b.Y,0))
            if ang < min_keep_deg and _segment_clear(a, c, boundary, trees, waters, clear, pads=[pad] if pad else None):
                changed=True  # drop the sharp vertex
            else:
                Q.append(b)
        Q.append(P[-1]); P=Q
        if not changed: break
    return P

def _merge_short_segments(P, min_len=ROAD_MIN_SEG_LEN):
    if len(P)<2: return list(P)
    Q=[P[0]]
    for i in range(1,len(P)):
        if Q[-1].DistanceTo(P[i]) < min_len:
            if i<len(P)-1: continue
        Q.append(P[i])
    R=[Q[0]]
    for i in range(1,len(Q)):
        if R[-1].DistanceTo(Q[i])>1e-6: R.append(Q[i])
    return R

# ---- A* fallback bits ----
def _snap(p,o,s): return (int(round((p.X-o.X)/s)), int(round((p.Y-o.Y)/s)))
def _grid(ij,o,s): return rg.Point3d(o.X+ij[0]*s, o.Y+ij[1]*s, 0)
def _build_mask(boundary, trees, waters, pads, step, clear):
    bb=boundary.GetBoundingBox(True)
    origin=rg.Point3d(math.floor(bb.Min.X/step)*step, math.floor(bb.Min.Y/step)*step, 0)
    trees=[t for t in (trees or []) if _ok(t)]; waters=[w for w in (waters or []) if _ok(w)]
    def blocked(i,j):
        p=_grid((i,j),origin,step)
        if not _contains(boundary,p): return True
        if any(_contains(r,p) for r in (pads or [])): return True
        for t in trees:
            r,c=_tree_radius_center(t)
            if p.DistanceTo(c) < r+clear: return True
        if any(_min_dist_pt_crv(p,w)<clear for w in waters): return True
        return False
    return origin, blocked, bb

def _dirang(a,b):
    if a is None or b is None: return 0.0
    A=math.atan2(a[1],a[0]); B=math.atan2(b[1],b[0])
    return abs((B-A+math.pi)%(2*math.pi)-math.pi)

def _astar(start, goal, origin, blocked, bb, step, max_expand=35000):
    si,sj=_snap(start,origin,step); gi,gj=_snap(goal,origin,step)
    imin=int(math.floor((bb.Min.X-origin.X)/step))-2; imax=int(math.ceil((bb.Max.X-origin.X)/step))+2
    jmin=int(math.floor((bb.Min.Y-origin.Y)/step))-2; jmax=int(math.ceil((bb.Max.Y-origin.Y)/step))+2
    inb=lambda i,j:(imin<=i<=imax) and (jmin<=j<=jmax)
    h=lambda i,j: math.hypot(i-gi,j-gj)
    def nearfree(i0,j0,r=3):
        best=None; d0=1e9
        for di in range(-r,r+1):
            for dj in range(-r,r+1):
                ii,jj=i0+di,j0+dj
                if inb(ii,jj) and not blocked(ii,jj):
                    d=di*di+dj*dj
                    if d<d0: d0=d; best=(ii,jj)
        return best
    if blocked(si,sj):
        nf=nearfree(si,sj); 
        if nf: si,sj=nf
    if blocked(gi,gj):
        nf=nearfree(gi,gj); 
        if nf: gi,gj=nf
    moves=[(-1,0,1.0),(1,0,1.0),(0,-1,1.0),(0,1,1.0),(-1,-1,math.sqrt(2)),(-1,1,math.sqrt(2)),(1,-1,math.sqrt(2)),(1,1,math.sqrt(2))]
    pq=[]; heapq.heappush(pq,(h(si,sj),0.0,(si,sj),None,None))
    came={}; g={(si,sj):0.0}; seen=set(); expands=0
    while pq:
        _,gc,node,parent,prev=heapq.heappop(pq)
        if node in seen: continue
        came[node]=parent; seen.add(node); expands+=1
        if expands>max_expand: return None
        if node==(gi,gj):
            path=[]; cur=node
            while cur is not None: path.append(cur); cur=came[cur]
            path.reverse(); return [_grid(n,origin,step) for n in path]
        i,j=node
        for di,dj,base in moves:
            ii,jj=i+di,j+dj
            if not inb(ii,jj) or blocked(ii,jj): continue
            ang=_dirang(prev,(di,dj)); ng=gc+base+TURN_PENALTY*(ang/math.pi)
            if (ii,jj) not in g or ng<g[(ii,jj)]:
                g[(ii,jj)]=ng; heapq.heappush(pq,(ng+h(ii,jj),ng,(ii,jj),node,(di,dj)))
    return None

# ---- router with simple fallbacks ----
def route_polyline(boundary, trees, waters, pad_rect, side, step, clear, apron_out):
    touch, entry = boundary_touch_points(boundary, side, 0.5)
    goal, pre, n = _goal_points(pad_rect, entry, apron_out, APPROACH_LEAD_IN)
    pads=[pad_rect]

    # 1) direct line
    if _segment_clear(entry, goal, boundary, trees, waters, clear, pads=pads):
        pts=[touch, entry, goal]
    else:
        # 2) L-shape candidates
        via1=rg.Point3d(entry.X, goal.Y, 0)
        via2=rg.Point3d(goal.X,  entry.Y, 0)
        paths=[]
        for via in (via1, via2):
            if (_segment_clear(entry, via, boundary, trees, waters, clear, pads=pads) and
                _segment_clear(via, goal, boundary, trees, waters, clear, pads=pads)):
                paths.append([touch, entry, via, goal])
        if paths:
            pts=min(paths, key=lambda P: sum(P[i].DistanceTo(P[i+1]) for i in range(len(P)-1)))
        else:
            # 3) A* fallback, then compress
            origin,blocked,bb=_build_mask(boundary, trees, waters, pads, step, clear)
            path=_astar(entry, pre, origin, blocked, bb, step) or _astar(entry, goal, origin, blocked, bb, step)
            if not path: return None
            # line-of-sight compression
            mid=[path[0]]
            for k in range(1,len(path)):
                if not _segment_clear(mid[-1], path[k], boundary, trees, waters, clear, pads=pads):
                    mid.append(path[k-1])
            mid.append(path[-1])
            pts=[touch, entry]+mid

    # keep last leg straight out of the pad and simplify
    if pts[-1].DistanceTo(goal)>1e-6: pts.append(goal)
    # drop vertices inside pad
    pts=[q for q in pts if not _contains(pad_rect, q)]
    pts=_drop_kinks(pts, boundary, trees, waters, clear, pad_rect, MIN_BEND_KEEP_DEG, passes=4)
    pts=_merge_short_segments(pts, ROAD_MIN_SEG_LEN)

    # final safety
    for i in range(len(pts)-1):
        if not _segment_clear(pts[i], pts[i+1], boundary, trees, waters, clear, pads=pads): return None
    return rg.PolylineCurve(pts) if len(pts)>=2 else None

def route_road(boundary, trees, waters, pads):
    if not pads: return None
    sides=[entrance_side, ("east" if entrance_side in ("south","north") else "south")]
    for p in pads:
        for s in sides:
            st=ROAD_STEP_DEFAULT
            for _ in range(2):
                r=route_polyline(boundary, trees, waters, p, s, st, ROAD_CLEAR, 0.7)
                if r: return r
                st*=0.5
    # last tiny fallback
    touch,entry=boundary_touch_points(boundary, sides[0], 0.5)
    goal,_,_=_goal_points(pads[0], entry, 0.7, APPROACH_LEAD_IN)
    if not (_segment_clear(touch, entry, boundary, trees, waters, ROAD_CLEAR, pads=pads) and
            _segment_clear(entry, goal,  boundary, trees, waters, ROAD_CLEAR, pads=pads)):
        return None
    return rg.PolylineCurve([touch,entry,goal])

# =========================== Main ============================
def run():
    random.seed(seed)
    size=LOT_SIZES[lot_type]
    boundary=create_organic_boundary(size["width"], size["depth"], 0,0)
    road=None; pads=[]; waters=[]; trees=[]
    for _ in range(MAX_SITE_RETRIES+1):
        waters=add_water_feature(boundary, True)
        trees =add_trees(boundary, tree_clusters, waters)
        pads  =place_building_zones(boundary, size, trees, waters, one_per_lot)
        road  =route_road(boundary, trees, waters, pads) if pads else None
        if pads and road: break

    site_boundaries.append(boundary)
    buildable_zones.extend(pads)
    water_features.extend(waters)
    tree_zones.extend(trees)
    if road: access_roads.append(road)

    info="{} LOT\nSize: {}x{}m\nTrees: {}\nPads: {}\nWater features: {}\nRoad: {}".format(
        lot_type.upper(), size["width"], size["depth"], len(trees), len(pads), len(waters),
        "Yes" if road else "No path")
    site_info.append(info)

run()
# ---------- end python_3_script ----------

# ----
number_slider_2 = Slider(3, range=0..10)
# You are an architect conducting site analysis to inform building massing and program layout.
# Site Legend
# 
# North: Top of image
# Green circles: Trees
# Blue: Water feature
# Red: Buildable zone
# Grey: Access road
# Black: Property boundary
# GridLines: each square is 10x10 meters to give scale
# 
# Provide Architectural Response:
# 1. Site Reading (2 sentences)
# What is the site telling you? Identify the dominant spatial condition and opportunity.
# 2. Massing Concept
# Form: How is the planning layout?
# Logic: How does this form respond to the site and climate?
# Orientation: Building's primary axis and why
# 3. Program Distribution Strategy
# Describe where spaces go and why, like an architect would:
# Place living spaces [where] to [capture what]. Position bedrooms and any other rooms that can be a part of the house related to the users and the local culture [where] for [privacy/views/shade]. Locate entry [where] to [create what experience].
# 4. Critical Moves
# Three essential design decisions:
# 
# View axis: From [where] to [what]
# Threshold: How you enter and what you see
# Edge: How building meets [water/trees/road/site features]
# 
# 5. Spatial Diagram
# Simple relationship sketch. Provide also the location and orientation of where features are if north is on top of image and make sure to be explicit for instructions to someone else who hasn't been to the site.
# 
# Output
# Write as you would present to a client - clear design intent focused on experience and site response. Maximum 200 words.
# 
# Analyze this site and describe the massing strategy.
point = Point()
# You are an architect conducting site analysis for building massing and program layout.
# 
# Site Legend (interpret image accordingly)
# 
# North = top of image
# 
# Green circles = Trees
# 
# Blue = Water feature (pond/stream/pool)
# 
# Red = Buildable zone
# 
# Grey = Access road
# 
# Black = Property boundary
# 
# Grid = 10 × 10 m squares (scale reference)
# 
# Architectural Response (Max 200 words, client-facing clarity)
# 
# Site Reading: 2 sentences. State dominant spatial condition + site opportunities.
# 
# Massing Concept:
# 
# Form: organizing geometry.
# 
# Climate Response: orientation for sun/shade/wind.
# 
# Orientation: main axis & reason.
# 
# Program Strategy:
# 
# Living/social spaces: where & why.
# 
# Bedrooms/private spaces: where & why (privacy, shade, culture).
# 
# Entry: where & why (arrival experience).
# 
# Critical Moves (3 design decisions):
# 
# View axis: from → to.
# 
# Threshold: entry sequence.
# 
# Edge: how building meets water/trees/road.
# 
# Spatial Diagram (verbal): Describe relative placement of rooms, road, water, and trees clearly, as if sketching for someone off-site.
point_2 = Point()
vec2pt = Vector2Pt(PointA=point, PointB=point_2, Unitize=False)  # -> Vector, Length
negative = Negative(Value=number_slider_2)
curve = Curve(python_3_script.tree_zones)
curve_2 = Curve(python_3_script.access_roads)
curve_3 = Curve(python_3_script.site_boundaries)
curve_4 = Curve(python_3_script.water_features)
curve_5 = Curve(python_3_script.buildable_zones)
# You are an architect’s copilot. Analyze the provided site image and return a compact, structured site strategy that a second model will use to lay out building spaces.
# 
# INTERPRETATION LEGEND (from image)
# - North = top of image
# - East = right of image
# -West = left of image
# -South = bottom of image
# - Green circles = Trees
# - Blue = Water feature (pond/stream/pool)
# - Red = Buildable zone
# - Grey = Access road
# - Black = Property boundary
# - Grid = 10 × 10 m squares (scale reference)
# 
# REQUIREMENTS
# - Be location-aware: use cardinal directions (north/south/east/west) and “edge/corner/center” of the plot.
# - Prioritize climate response, privacy hierarchy, and cultural expectations.
# - Output **valid JSON only**, max ~200 words across text fields.
# - Do not include comments or extra text outside JSON.
# 
# OUTPUT JSON SCHEMA
# {
#   "site_reading": "<2-sentence summary: dominant spatial condition + key opportunity>",
#   "massing_concept": {
#     "form": "<linear | courtyard | L-shaped | cluster | bar | compact | other>",
#     "climate_response": "<how orientation/form addresses sun, wind, shade>",
#     "orientation": "<primary axis and why (e.g., east–west bar to shade south)>"
#   },
#   "program_strategy": {
#     "living_spaces": "<where & why (e.g., north edge to face trees, filtered light)>",
#     "private_spaces": "<where & why (e.g., east side for morning sun, privacy)>",
#     "entry": "<where & why (e.g., south edge from road, framed threshold)>"
#   },
#   "critical_moves": {
#     "view_axis": "from <location> to <feature>",
#     "threshold": "<entry sequence and first reveal>",
#     "edge": "<how building meets water/trees/road/boundary>"
#   },
#   "spatial_diagram": {
#     "living": "<relative placement>",
#     "bedrooms": "<relative placement>",
#     "kitchen_dining": "<relative placement>",
#     "entry": "<relative placement>",
#     "notes": "<key adjacencies/orientation cues>"
#   },
#   "early_adjacency_graph": {
#     "nodes": [
#       {
#         "id": "<lowercase identifier>",
#         "role": "<entry | living | kitchen | dining | bedroom | bath | service | outdoor | circulation>",
#         "preferred_zone": "<north|south|east|west|center|nw|ne|sw|se>",
#         "level": "<0|1|2>",
#         "priority": "<primary|secondary>",
#         "notes": "<short rationale>"
#       }
#     ],
#     "edges": [
#       ["<node_id_A>", "<node_id_B>", "<type: direct|visual|service>", "<strength: strong|moderate|weak>"]
#     ]
#   },
#   "site_features": {
#     "road_access": "<where (e.g., south edge, mid)>",
#     "water_feature": "<where (e.g., northwest corner, along north edge)>",
#     "tree_clusters": "<where (e.g., north band, sparse east)>",
#     "buildable_zone": "<shape & where (e.g., central rectangle set back from water)>",
#     "constraints": "<setbacks, no-build edges, flood/steep areas if any>"
#   }
# }
cameraposition = Python3Script(unitcenter=point, cameradir=vec2pt.Vector)  # -> out, a; inputs unitcenter: Point3d, cameradir: Vector3d; disabled
# ---------- cameraposition: Python ----------
# import rhinoscriptsyntax as rs

# view = rs.CurrentView()
# camera = x
# target = y
# if camera: rs.ViewCamera(view,camera)
# if camera: rs.ViewCameraTarget(view, camera, target)
import scriptcontext as sc
import Rhino.Geometry as rg
import rhinoscriptsyntax as rs

def zoom_view_to_brep(brep):
    # Get the bounding box of the brep.
    bbox = rs.BoundingBox(brep)
    if not bbox:
        rs.MessageBox("No bounding box.", 0, "Error")
        return

    # Compute the center of the bounding box.
    center = rs.PointDivide(rs.PointAdd(bbox[0], bbox[6]), 2.0)

    # For an axonometric view, choose a common isometric direction.
    direction = rs.VectorUnitize([0, 0, -1])

    # Use the diagonal of the bounding box to compute a good distance.
    diag = rs.Distance(bbox[0], bbox[6])
    distance = diag * 3

    # Compute the camera position by offsetting the center along the chosen direction.
    camera = rs.PointAdd(center, rs.VectorScale(direction, distance))

    # Get the active view via RhinoCommon.
    # Get the specified view by name instead of using the active view
    view_name = "Top"
    for view_obj in sc.doc.Views:
        print(view_obj.ActiveViewport.Name)
        if view_obj.ActiveViewport.Name == view_name:
            view = view_obj
            print(view.ActiveViewport.Name)
            break

    # Set the view to Parallel (axonometric) projection.
    # view.ActiveViewport.CameraParallelProjection = True

    # Use RhinoCommon's method to set both camera and target.
    view.ActiveViewport.SetCameraLocations(camera, center)
    
    # Redraw the view.
    view.Redraw()

# # Example usage:
# if brep:
#     zoom_view_to_brep(brep)
# else:
#     rs.MessageBox("No brep provided!", 0, "Error")

# unitcenter = 
# cameradir = 
distance = 1000
camera = rs.PointAdd(unitcenter, rs.VectorScale(cameradir, distance))
# Get the active view via RhinoCommon.
view = sc.doc.Views.ActiveView
view.ActiveViewport.Camera35mmLensLength = camlens
# Set the view to Parallel (axonometric) projection.
# view.ActiveViewport.CameraParallelProjection = True

# Use RhinoCommon's method to set both camera and target.
view.ActiveViewport.SetCameraLocations(camera, unitcenter)
# view.Camera35mmLensLength = 20
# Redraw the view.
view.Redraw()
# ---------- end cameraposition ----------
offset_curve = OffsetCurve(Curve=curve_2, Plane=PlaneXY(0, 0, 0), Distance=number_slider_2, BothSides=negative, Kinks=0, CapType=1)
panel_2 = Panel(python_3_script.site_info)
area = Area(Geometry=curve_5)  # -> Area, Centroid
# You are an architect conducting a site analysis to inform building massing and program layout.
# 
# Site Legend (interpret the image accordingly)
# 
# North = top of image
# 
# Green circles = Trees
# 
# Blue = Water feature (pond, stream, or pool)
# 
# Red = Buildable zone
# 
# Grey = Access road
# 
# Black = Property boundary
# 
# Grid = Each square is 10 × 10 m (scale reference)
# 
# Architectural Response (Max 200 words, clear intent for a client)
# 
# Site Reading (2 sentences)
# 
# What is the dominant spatial condition?
# 
# What opportunities does the site offer?
# 
# Massing Concept
# 
# Form: What is the organizing geometry or spatial logic?
# 
# Climate Response: How does form/orientation respond to sun, shade, wind?
# 
# Orientation: Primary building axis and why.
# 
# Program Distribution Strategy
# 
# Living/social spaces: where & why.
# 
# Bedrooms/private spaces: where & why (consider privacy, shade, or cultural values).
# 
# Entry: where & why (arrival experience).
# 
# Critical Moves (three design decisions)
# 
# View axis: From where to what?
# 
# Threshold: How entry sequence unfolds.
# 
# Edge: How building meets water/trees/road/site features.
# 
# Spatial Diagram (describe clearly in words)
# 
# Explain relative placement of rooms, road, water, and trees as if drawing a diagram for someone who hasn’t seen the site.
panel_3 = Panel(area.Area)
number_slider_3 = Slider(3, range=1..21)
boundary_surfaces = BoundarySurfaces(Edges=curve)
boolean_toggle = BooleanToggle(False)
boundary_surfaces_2 = BoundarySurfaces(Edges=curve_4)
boundary_surfaces_3 = BoundarySurfaces(Edges=curve_5)
boundary_surfaces_4 = BoundarySurfaces(Edges=offset_curve)
number_slider_4 = Slider(1, range=1..21)
number_slider_5 = Slider(10, range=0..10)
number = Number(number_slider)
number_2 = Number(panel_3)
boundary_surfaces_5 = BoundarySurfaces(Edges=curve_3)
bounding_rectangle = BoundingRectangle(Geometry=boundary_surfaces_5, Plane=PlaneXY(0, 0, 0), Axis=0, Slide=0, Union=True)  # -> Bounding, DimensionX, DimensionY

# ---- group: create path name
python_3_script_2 = Python3Script(site_info=panel_2, seed=number, pad_area=number_2)  # -> out, fname; inputs site_info: list of String, seed: Int32, pad_area: Double
# ---------- python_3_script_2: Python ----------
import os, re, datetime

def parse_info_card(s, fallback_meta=None):
    """
    Robustly parse the info block:
      XL LOT
      Size: 150x120m
      Trees: 18
      Pads: 1
      Water features: 1
      Road: Yes
    Returns {} if something essential is missing.
    """
    s = (s or "")
    # normalize newlines & strip weird chars (ANSI, etc.)
    s = s.replace("\r\n", "\n")
    s = "".join(ch for ch in s if ch == "\n" or 32 <= ord(ch) <= 126)
    lines = [ln.strip() for ln in s.split("\n") if ln.strip()]

    meta = dict(fallback_meta or {})

    # LOT
    for ln in lines:
        m = re.search(r"([A-Za-z]+)\s+LOT\b", ln, re.I)
        if m: meta["lot"] = m.group(1).upper(); break

    # Size
    for ln in lines:
        m = re.search(r"Size:\s*(\d+)\s*[x×]\s*(\d+)\s*m", ln, re.I)
        if m: meta["width"], meta["depth"] = int(m.group(1)), int(m.group(2)); break

    # Trees / Pads / Water / Road
    for ln in lines:
        m = re.search(r"Trees:\s*(\d+)", ln, re.I)
        if m: meta["trees"] = int(m.group(1)); break

    for ln in lines:
        m = re.search(r"Pads:\s*(\d+)", ln, re.I)
        if m: meta["pads"] = int(m.group(1)); break

    for ln in lines:
        m = re.search(r"Water\s*features?:\s*(\d+)", ln, re.I)
        if m: meta["waters"] = int(m.group(1)); break

    for ln in lines:
        m = re.search(r"Road:\s*(Yes|No)", ln, re.I)
        if m: meta["road"] = (m.group(1).lower() == "yes"); break

    required = ("lot","width","depth","trees","pads","waters","road")
    if not all(k in meta for k in required):
        return {}
    return meta

def meta_from_variables():
    size = globals().get("size") or {}
    return {
        "lot": (globals().get("lot_type","LOT") or "LOT").upper(),
        "width": int(size.get("width", 0) or 0),
        "depth": int(size.get("depth", 0) or 0),
        "trees": len(globals().get("tree_zones", []) or []),
        "pads": len(globals().get("buildable_zones", []) or []),
        "waters": len(globals().get("water_features", []) or []),
        "road": bool(globals().get("access_roads", []) )
    }

def safe_slug(s):
    return re.sub(r"[^A-Za-z0-9._-]+", "_", str(s)).strip("_")

def build_plot_filename_from_info(info_string, seed=None, extra=None, ext="png"):
    # Try parsing the card; if it fails, derive from variables
    meta = parse_info_card(info_string)
    if not meta:
        meta = meta_from_variables()
    if not meta.get("width"):  # final fallback: timestamp
        stamp = datetime.datetime.now().strftime("%Y%m%d_%H%M%S")
        return f"site_{stamp}.{ext}"

    base = f"{meta['lot']}_{meta['width']}x{meta['depth']}m_T{meta['trees']}_P{meta['pads']}_W{meta['waters']}_R{'Y' if meta['road'] else 'N'}"
    if extra:
        base += "_" + safe_slug(extra)
    if seed is not None:
        base += f"_seed{seed}"
    return base + "." + ext

info_str = site_info[-1] if site_info else ""

fname = build_plot_filename_from_info(info_str, seed=seed, extra=f"area{int(globals().get('pad_area',0))}")
print(fname)   # e.g. XL_150x120m_T18_P1_W1_RY_seed42.png
# ---------- end python_3_script_2 ----------

# ----
brute_force_classic = BruteForceClassic(Run=Toggle(False), NumberSliders=number_slider_4)
division = Division(A=bounding_rectangle.DimensionX, B=number_slider_5)
division_2 = Division(A=bounding_rectangle.DimensionY, B=number_slider_5)
custom_preview = CustomPreview(Geometry=boundary_surfaces, Material=ColourSwatch(SwatchColor=RGB(106, 217, 78)))
custom_preview_2 = CustomPreview(Geometry=boundary_surfaces_2, Material=ColourSwatch(SwatchColor=RGB(19, 214, 201)))
custom_preview_3 = CustomPreview(Geometry=boundary_surfaces_4, Material=ColourSwatch(SwatchColor=RGB(158, 158, 158)))
custom_preview_4 = CustomPreview(Geometry=boundary_surfaces_3, Material=ColourSwatch(SwatchColor=RGB(255, 143, 143)))
custom_preview_5 = CustomPreview(Geometry=boundary_surfaces_5, Material=ColourSwatch(SwatchColor=RGBA(255, 255, 255, 0)))  # disabled
panel_4 = Panel(python_3_script_2.fname)
custom_preview_lineweights = CustomPreviewLineweights(Geometry=curve_3, Shader=ColourSwatch(SwatchColor=RGB(0, 0, 0)), Thickness=Slider(3, range=0..10), Absolute=False)
divide_surface = DivideSurface(Surface=bounding_rectangle.Bounding, UCount=division, VCount=division_2)  # -> Points, Normals, Parameters

# ---- group: Site Analysis
python_3_script_3 = Python3Script(idx=number_slider_3)  # -> out, city, prompt; inputs idx: Int32
# ---------- python_3_script_3: Python ----------
location = {
  "P1_Locations": [
    { "id": 1, "city": "Cairo", "country": "Egypt", "climate": "Hot Desert (BWh)", "notes": "Very dry, extreme heat" },
    { "id": 2, "city": "Riyadh", "country": "Saudi Arabia", "climate": "Hot Desert (BWh)", "notes": "High diurnal variation" },
    { "id": 3, "city": "Istanbul", "country": "Turkey", "climate": "Mediterranean (Csa)", "notes": "Mixed seasonal performance" },
    { "id": 4, "city": "Barcelona", "country": "Spain", "climate": "Mediterranean (Csa)", "notes": "Warm summers, mild winters" },
    { "id": 5, "city": "Paris", "country": "France", "climate": "Oceanic (Cfb)", "notes": "Mild, humid year-round" },
    { "id": 6, "city": "London", "country": "United Kingdom", "climate": "Oceanic (Cfb)", "notes": "Cool summers, rainy winters" },
    { "id": 7, "city": "Berlin", "country": "Germany", "climate": "Continental (Dfb)", "notes": "Cold winters, warm summers" },
    { "id": 8, "city": "Moscow", "country": "Russia", "climate": "Cold Continental (Dfb/Dfc)", "notes": "Harsh winters" },
    { "id": 9, "city": "Helsinki", "country": "Finland", "climate": "Subarctic (Dfc)", "notes": "Short cool summers" },
    { "id": 10, "city": "New Delhi", "country": "India", "climate": "Humid Subtropical (Cwa)", "notes": "Hot summers, monsoon" },
    { "id": 11, "city": "Mumbai", "country": "India", "climate": "Tropical Wet & Dry (Aw)", "notes": "Heavy monsoon rains" },
    { "id": 12, "city": "Bangkok", "country": "Thailand", "climate": "Tropical Monsoon (Am)", "notes": "High humidity, rainfall" },
    { "id": 13, "city": "Singapore", "country": "Singapore", "climate": "Tropical Rainforest (Af)", "notes": "Uniformly hot & humid" },
    { "id": 14, "city": "Beijing", "country": "China", "climate": "Monsoon-Influenced Continental (Dwa)", "notes": "Cold dry winters, humid summers" },
    { "id": 15, "city": "Tokyo", "country": "Japan", "climate": "Humid Subtropical (Cfa)", "notes": "Hot humid summers, mild winters" },
    { "id": 16, "city": "Sydney", "country": "Australia", "climate": "Humid Subtropical (Cfa)", "notes": "Moderate year-round" },
    { "id": 17, "city": "Melbourne", "country": "Australia", "climate": "Oceanic (Cfb)", "notes": "Cool, changeable" },
    { "id": 18, "city": "Mexico City", "country": "Mexico", "climate": "Subtropical Highland (Cwb)", "notes": "Mild due to altitude" },
    { "id": 19, "city": "São Paulo", "country": "Brazil", "climate": "Humid Subtropical (Cfa)", "notes": "Warm wet summers" },
    { "id": 20, "city": "Buenos Aires", "country": "Argentina", "climate": "Humid Subtropical (Cfa)", "notes": "Hot summers, mild winters" },
    { "id": 21, "city": "Los Angeles", "country": "USA", "climate": "Mediterranean (Csa)", "notes": "Hot dry summers, mild winters" }
  ]
}


for i in location['P1_Locations']:
    print(i)

city = location['P1_Locations'][idx]["city"]
country = location['P1_Locations'][idx]["country"]
climate = location['P1_Locations'][idx]["climate"]
notes = location['P1_Locations'][idx]["notes"]

prompt = f"""Analyze this image of the site that is located in {city}, {country}, with this climate {climate} {notes}."""
# ---------- end python_3_script_3 ----------

python_3_script_4 = Python3Script(idx=number_slider_4)  # -> out, city, prompt; inputs idx: Int32
# ---------- python_3_script_4: Python ----------
families = {
  "P2_FamilyTypologies": [
    { "id": 1, "family": "Single adult", "profession": "Remote tech worker", "notes": "High digital needs, home office" },
    { "id": 2, "family": "Single adult", "profession": "Artist / Freelancer", "notes": "Studio or workshop space" },
    { "id": 3, "family": "Couple (2 adults)", "profession": "Both office workers", "notes": "Daily commuting" },
    { "id": 4, "family": "Couple (2 adults)", "profession": "Remote worker + healthcare", "notes": "Mixed schedules" },
    { "id": 5, "family": "Couple (2 adults)", "profession": "Retired", "notes": "Focus on comfort & accessibility" },
    { "id": 6, "family": "3 members (2 adults + 1 child)", "profession": "Tech + teacher", "notes": "School commute" },
    { "id": 7, "family": "3 members (2 adults + 1 elder parent)", "profession": "Mixed work", "notes": "Multigenerational living" },
    { "id": 8, "family": "4 members (2 adults + 2 children)", "profession": "Engineers", "notes": "Need study and play spaces" },
    { "id": 9, "family": "4 members (2 adults + 2 children)", "profession": "Healthcare + retail", "notes": "Shift-based routines" },
    { "id": 10, "family": "4 members (2 adults + 2 children)", "profession": "Artists", "notes": "Creative use of space" },
    { "id": 11, "family": "5 members (2 adults + 3 children)", "profession": "Tech + homemaker", "notes": "Larger bedrooms required" },
    { "id": 12, "family": "5 members (3 adults + 2 children)", "profession": "Family business", "notes": "Shared workspace needed" },
    { "id": 13, "family": "5 members (2 adults + 2 children + 1 elder)", "profession": "Teacher + doctor", "notes": "Care responsibilities" },
    { "id": 14, "family": "6 members (2 adults + 4 children)", "profession": "Mixed professions", "notes": "Large family housing" },
    { "id": 15, "family": "6 members (3 adults + 3 children)", "profession": "Family-owned shop", "notes": "Work/live mixed" },
    { "id": 16, "family": "7 members (2 adults + 5 children)", "profession": "Farming", "notes": "Outdoor/agricultural needs" },
    { "id": 17, "family": "7 members (2 adults + 3 children + 2 elders)", "profession": "Mixed work", "notes": "Generational overlap" },
    { "id": 18, "family": "8 members (Extended family)", "profession": "Retail + service jobs", "notes": "Shared kitchen priority" },
    { "id": 19, "family": "9 members (Large family)", "profession": "Mixed professions", "notes": "Multi-bedroom demand" },
    { "id": 20, "family": "10 members (3 generations)", "profession": "Farming + trades", "notes": "Strong communal areas" },
    { "id": 21, "family": "Cohousing (Unrelated adults)", "profession": "Students / professionals", "notes": "Shared facilities" }
  ]
}

family = families["P2_FamilyTypologies"][idx]["family"]
profession = families["P2_FamilyTypologies"][idx]["profession"]
notes = families["P2_FamilyTypologies"][idx]["notes"]

prompt = f"""The people who are going to live here are {family}, that are {profession}, and will need {notes}."""

print(prompt)
# ---------- end python_3_script_4 ----------

# ----
file_path = FilePath("C:\Users\user\Documents\GitHub\ThesisDesignAgent\grasshopperFiles\site_plans\")
curve_6 = Curve(curve_3)
panel_5 = Panel("""You are an architect’s copilot conducting a site analysis to directly inform space planning and layout.
Your goal is to read the site diagram and return a structured analysis that identifies the location, orientation, and relationships of features.
Your output must be clear enough for another AI to design a building massing and distribute spaces correctly.

Site Legend (interpret the image accordingly)

North = top of image

Green circles = Trees

Blue = Water feature (pond, stream, or pool)

Red = Buildable zone

Grey = Access road

Black = Property boundary

Grid = 10 × 10 m squares (scale reference)
{
  "site_reading": "2-sentence summary of dominant spatial condition + opportunity",
  "massing_concept": {
    "form": "Organizing geometry (linear, courtyard, cluster, etc.)",
    "climate_response": "How orientation/shape responds to sun, wind, shade",
    "orientation": "Primary building axis and why"
  },
  "program_strategy": {
"entry": "Where to place entry and the intended experience. This should make logical sense and relate to the site condiions"
    "living_spaces": "Where to locate living/social spaces and why",
    "private_spaces": "Where to locate bedrooms/private spaces and why",
    
  },
  "critical_moves": {
    "view_axis": "From [location] to [feature]",
    "threshold": "How entry sequence unfolds",
    "edge": "How the building meets road/trees/water"
  },
  "spatial_diagram": {
    "living": "Relative location (e.g. north edge facing trees)",
    "bedrooms": "Relative location (e.g. east side for shade/privacy)",
    "kitchen_dining": "Relative location (e.g. near living, facing courtyard)",
    "entry": "Relative location (e.g. south edge connected to road)",
    "other": "Notes on adjacency and orientation of special features"
  }
}
Rules: 

Always specify cardinal directions (north, south, east, west) for space/feature placement.

Ensure program placement aligns with privacy, culture, and climate adaptation.

Keep total response under 200 words but fully structured in JSON.

Output must be valid JSON only.""")
panel_6 = Panel(python_3_script_3.prompt)
panel_7 = Panel(python_3_script_4.prompt)

# ---- group: save plot for LLM
python_3_script_5 = Python3Script(plot_outline_curve=curve_6, SAVE_DIR=file_path, fname=panel_4)  # -> out, png_path; inputs plot_outline_curve: Curve
# ---------- python_3_script_5: Python ----------
import os, base64, uuid, tempfile
import Rhino
import Rhino.Geometry as rg
import scriptcontext as sc
from System.Drawing.Imaging import ImageFormat

# --- Focus Top on plot outline (keeps it fully inside frame) ---
def focus_top_on(plot_geom, pad_frac=0.04, view_name="Top"):
    if plot_geom is None:
        raise ValueError("plot_geom is None")
    bbox = plot_geom.GetBoundingBox(True)
    if not bbox.IsValid:
        raise ValueError("Invalid plot bbox")

    # Pad the bbox a bit so geometry isn't glued to the image edge
    dx = bbox.Max.X - bbox.Min.X
    dy = bbox.Max.Y - bbox.Min.Y
    pad = max(dx, dy) * float(pad_frac)
    bbox = rg.BoundingBox(
        rg.Point3d(bbox.Min.X - pad, bbox.Min.Y - pad, bbox.Min.Z - 1.0),
        rg.Point3d(bbox.Max.X + pad, bbox.Max.Y + pad, bbox.Max.Z + 1.0)
    )

    # Find the Top view if it exists, otherwise use the active view
    view = sc.doc.Views.Find(view_name, False) or sc.doc.Views.ActiveView
    if view is None:
        raise RuntimeError("No Rhino view available")

    vp = view.ActiveViewport

    # Force a Top/parallel projection (try several APIs for compatibility)
    proj = Rhino.Display.DefinedViewportProjection.Top
    ok = False
    for args in [
        (proj, True, True, True),   # Rhino 8
        (proj, True, True),         # some builds
        (proj, True),               # some builds
        (proj,)                     # older builds
    ]:
        try:
            if vp.SetProjection(*args):
                ok = True
                break
        except:
            pass
    try:
        vp.ChangeToParallelProjection(True)
    except:
        pass
    try:
        vp.SetToPlanView(rg.Plane.WorldXY, True)
    except:
        pass

    # Canonical Top orientation
    try:
        vp.SetCameraDirection(rg.Vector3d(0, 0, -1), True)
    except:
        vp.CameraDirection = rg.Vector3d(0, 0, -1)
    vp.CameraUp = rg.Vector3d(0, 1, 0)

    # Clean capture (hide grids/axes)
    vp.ConstructionGridVisible = False
    vp.ConstructionAxesVisible = False
    vp.WorldAxesVisible = False

    # Zoom to bbox
    vp.ZoomBoundingBox(bbox)
    view.Redraw()
    return view

# --- Capture (instance-based ViewCapture → avoids your error) ---
def capture_view(view, path, width=1400, height=1400, display_mode="Arctic", transparent=False):
    dm = Rhino.Display.DisplayModeDescription.FindByName(display_mode)
    if dm:
        view.ActiveViewport.DisplayMode = dm
    sc.doc.Views.Redraw()

    vc = Rhino.Display.ViewCapture()
    vc.Width = int(width)
    vc.Height = int(height)
    vc.ScaleScreenItems = False
    vc.DrawGrid = False
    vc.DrawAxes = False
    vc.DrawGridAxes = False
    vc.TransparentBackground = bool(transparent)

    # IMPORTANT: instance method expects a RhinoView (not settings)
    bmp = vc.CaptureToBitmap(view)
    if bmp is None:
        raise RuntimeError("Capture failed (bitmap is None)")
    bmp.Save(path, ImageFormat.Png)
    return path

# --- Encode PNG/JPG to data-URI for LLMs ---
def encode_image_to_data_uri(path):
    ext = os.path.splitext(path)[1].lower().lstrip(".")
    mime = "image/jpeg" if ext in ("jpg", "jpeg") else "image/png"
    with open(path, "rb") as f:
        b64 = base64.b64encode(f.read()).decode("utf-8")
    return "data:%s;base64,%s" % (mime, b64)

# --- One-call helper: frame Top → capture → data-URI ---
def capture_topview_to_data_uri(plot_geom,
                                path=None,
                                width=1400,
                                height=1400,
                                pad_frac=0.04,
                                display_mode="Arctic",
                                transparent=False):
    import os, uuid, tempfile
    # If no explicit path, build one in SAVE_DIR (or temp if SAVE_DIR is not set/valid)
    if not path:
        out_dir = SAVE_DIR if (isinstance(SAVE_DIR, str) and len(SAVE_DIR) > 0) else tempfile.gettempdir()
        if not os.path.isdir(out_dir):
            try: os.makedirs(out_dir)
            except: out_dir = tempfile.gettempdir()
        path = os.path.join(out_dir, "site_top_%s.png" % uuid.uuid4().hex[:8])

    view = focus_top_on(plot_geom, pad_frac, view_name="Top")
    capture_view(view, path, width, height, display_mode, transparent)
    return path, encode_image_to_data_uri(path)

path = os.path.join(SAVE_DIR, fname)
png_path, data_uri = capture_topview_to_data_uri(plot_outline_curve,
                                                path = path,
                                                 width=1600, height=1600,
                                                 display_mode="Rendered",
                                                 transparent=False)
# ---------- end python_3_script_5 ----------

# ----
flip_matrix = FlipMatrix(Data=divide_surface.Points)
polyline = PolyLine(Vertices=flip_matrix, Closed=False)
polyline_2 = PolyLine(Vertices=divide_surface.Points, Closed=False)
panel_8 = Panel(python_3_script_5.png_path)
custom_preview_lineweights_2 = CustomPreviewLineweights(
    Geometry=[polyline_2, polyline],
    Shader=ColourSwatch(SwatchColor=RGB(173, 173, 173)),
    Thickness=Slider(1, range=0..10),
    Absolute=False)
concatenate = Concatenate(FragmentA=panel_6, FragmentB=panel_7)
panel_9 = Panel("qwen2.5")
panel_10 = Panel("local")
# You are an architect’s copilot.
# Analyze the provided site image and return a clear, structured **site strategy** that will guide another model in laying out building spaces.
# 
# ### INTERPRETATION LEGEND (from image)
# - North = top of image
# - East = right of image
# - West = left of image
# - South = bottom of image
# - Green circles = Trees
# - Blue = Water feature (pond, stream, or pool)
# - Red = Buildable zone
# - Grey = Access road
# - Black = Property boundary
# - Grid = 10 × 10 m squares (scale reference)
# 
# ### REQUIREMENTS
# - Always describe **where features and spaces are located** using cardinal directions and relative zones (north, south, east, west, center, NW, NE, SW, SE).
# - Be explicit: specify which edge or corner of the site features belong to.
# - Prioritize: **climate response**, **privacy hierarchy**, and **cultural expectations**.
# - Output must be **valid JSON only** (no extra text).
# - Limit descriptions to ~200 words across all text fields.
# 
# ---
# 
# ### OUTPUT JSON SCHEMA
# {
#   "site_reading": "<2-sentence summary: dominant spatial condition + key opportunity>",
# 
#   "massing_concept": {
#     "form": "<linear | courtyard | L-shaped | cluster | bar | compact | other>",
#     "climate_response": "<how form/orientation responds to sun, wind, shade>",
#     "orientation": "<primary axis and why (e.g., east–west bar to shade south)>"
#   },
# 
#   "program_strategy": {
#     "entry": "<where & why (e.g., south edge from road)>",
#     "living_spaces": "<where & why (e.g., north edge to face trees)>",
#     "private_spaces": "<where & why (e.g., east side for morning sun, privacy)>"
#   },
# 
#   "critical_moves": {
#     "view_axis": "from <location> to <feature>",
#     "threshold": "<entry sequence and first reveal>",
#     "edge": "<how building meets water/trees/road/boundary>"
#   },
# 
#   "spatial_diagram": {
#     "entry": "<relative placement, e.g., south edge from access road>",
#     "living": "<relative placement, e.g., north center facing trees>",
#     "bedrooms": "<relative placement, e.g., east edge for privacy>",
#     "kitchen_dining": "<relative placement, e.g., south near entry>",
#     "notes": "<key adjacencies/orientation cues>"
#   },
# 
#   "early_adjacency_graph": {
#     "nodes": [
#       {
#         "id": "<lowercase identifier>",
#         "role": "<entry | living | kitchen | dining | bedroom | bath | service | outdoor | circulation>",
#         "preferred_zone": "<north|south|east|west|center|nw|ne|sw|se>",
#         "level": "<0|1|2>",
#         "priority": "<primary|secondary>",
#         "notes": "<short rationale>"
#       }
#     ],
#     "edges": [
#       ["<node_id_A>", "<node_id_B>", "<connection type: direct|visual|service>", "<strength: strong|moderate|weak>"]
#     ]
#   },
# 
#   "site_features": {
#     "road_access": "<where, e.g., south edge mid>",
#     "water_feature": "<where, e.g., northwest corner>",
#     "tree_clusters": "<where, e.g., north band, sparse east>",
#     "buildable_zone": "<shape & where, e.g., central rectangle set back from water>",
#     "constraints": "<setbacks, no-build edges, flood/steep areas if any>"
#   }
# }
# You are an architect’s copilot.
# Analyze the provided site image and return a clear, structured **site strategy** that will guide another model in laying out building spaces.
# 
# ### INTERPRETATION LEGEND (from image)
# - North = top of image
# - East = right of image
# - West = left of image
# - South = bottom of image
# - Green circles = Trees
# - Blue = Water feature (pond, stream, or pool)
# - Red = Buildable zone
# - Grey = Access road
# - Black = Property boundary
# - Grid = 10 × 10 m squares (scale reference)
# 
# ### REQUIREMENTS
# - Always describe **where features are located** using cardinal directions and zones (north, south, east, west, center, or corners: NW, NE, SW, SE).
# - Be explicit: specify which edge or corner of the plot features belong to.
# - Prioritize: **climate response**, **privacy hierarchy**, and **cultural expectations**.
# - Output must be **valid JSON only** (no comments, no extra text).
# - Limit descriptions to ~200 words across all text fields.
# 
# ---
# 
# ### OUTPUT JSON SCHEMA
# {
#   "site_reading": "<2-sentence summary: dominant spatial condition + key opportunity>",
# 
#   "massing_concept": {
#     "form": "<linear | courtyard | L-shaped | cluster | bar | compact | other>",
#     "climate_response": "<how form/orientation responds to sun, wind, shade>",
#     "orientation": "<primary axis and why (e.g., east–west bar to shade south)>"
#   },
# 
#   "program_strategy": {
# "entry": "<where & why (e.g., south edge from road)>
#     "living_spaces": "<where & why (e.g., north edge to face trees)>",
#     "private_spaces": "<where & why (e.g., east side for morning sun, privacy)>",
#     },
# 
#   "critical_moves": {
#     "view_axis": "from <location> to <feature>",
#     "threshold": "<entry sequence and first reveal>",
#     "edge": "<how building meets water/trees/road/boundary>"
#   },
# 
#   "spatial_diagram": {
# "entry": "<relative placement (e.g., south edge from access road)>"
#     "living": "<relative placement (e.g., north center facing trees)>",
#     "bedrooms": "<relative placement (e.g., east edge for privacy)>",
#     "kitchen_dining": "<relative placement (e.g., south near entry)>",
#         "notes": "<key adjacencies/orientation cues>"
#   },
# 
#   "early_adjacency_graph": {
#     "nodes": [
#       {
#         "id": "<lowercase identifier>",
#         "role": "<entry | living | kitchen | dining | bedroom | bath | service | outdoor | circulation>",
#         "preferred_zone": "<north|south|east|west|center|nw|ne|sw|se>",
#         "level": "<0|1|2>",
#         "priority": "<primary|secondary>",
#         "notes": "<short rationale>"
#       }
#     ],
#     "edges": [
#       ["<node_id_A>", "<node_id_B>", "<connection type: direct|visual|service>", "<strength: strong|moderate|weak>"]
#     ]
#   },
# 
#   "site_features": {
#     "road_access": "<where (e.g., south edge, mid)>",
#     "water_feature": "<where (e.g., northwest corner, along north edge)>",
#     "tree_clusters": "<where (e.g., north band, sparse east)>",
#     "buildable_zone": "<shape & where (e.g., central rectangle set back from water)>",
#     "constraints": "<setbacks, no-build edges, steep/flood areas if any>"
#   }
# }
# {
#   "P1_Locations": [
#     { "id": 1, "city": "Cairo", "country": "Egypt", "climate": "Hot Desert (BWh)", "notes": "Very dry, extreme heat" },
#     { "id": 2, "city": "Riyadh", "country": "Saudi Arabia", "climate": "Hot Desert (BWh)", "notes": "High diurnal variation" },
#     { "id": 3, "city": "Istanbul", "country": "Turkey", "climate": "Mediterranean (Csa)", "notes": "Mixed seasonal performance" },
#     { "id": 4, "city": "Barcelona", "country": "Spain", "climate": "Mediterranean (Csa)", "notes": "Warm summers, mild winters" },
#     { "id": 5, "city": "Paris", "country": "France", "climate": "Oceanic (Cfb)", "notes": "Mild, humid year-round" },
#     { "id": 6, "city": "London", "country": "United Kingdom", "climate": "Oceanic (Cfb)", "notes": "Cool summers, rainy winters" },
#     { "id": 7, "city": "Berlin", "country": "Germany", "climate": "Continental (Dfb)", "notes": "Cold winters, warm summers" },
#     { "id": 8, "city": "Moscow", "country": "Russia", "climate": "Cold Continental (Dfb/Dfc)", "notes": "Harsh winters" },
#     { "id": 9, "city": "Helsinki", "country": "Finland", "climate": "Subarctic (Dfc)", "notes": "Short cool summers" },
#     { "id": 10, "city": "New Delhi", "country": "India", "climate": "Humid Subtropical (Cwa)", "notes": "Hot summers, monsoon" },
#     { "id": 11, "city": "Mumbai", "country": "India", "climate": "Tropical Wet & Dry (Aw)", "notes": "Heavy monsoon rains" },
#     { "id": 12, "city": "Bangkok", "country": "Thailand", "climate": "Tropical Monsoon (Am)", "notes": "High humidity, rainfall" },
#     { "id": 13, "city": "Singapore", "country": "Singapore", "climate": "Tropical Rainforest (Af)", "notes": "Uniformly hot & humid" },
#     { "id": 14, "city": "Beijing", "country": "China", "climate": "Monsoon-Influenced Continental (Dwa)", "notes": "Cold dry winters, humid summers" },
#     { "id": 15, "city": "Tokyo", "country": "Japan", "climate": "Humid Subtropical (Cfa)", "notes": "Hot humid summers, mild winters" },
#     { "id": 16, "city": "Sydney", "country": "Australia", "climate": "Humid Subtropical (Cfa)", "notes": "Moderate year-round" },
#     { "id": 17, "city": "Melbourne", "country": "Australia", "climate": "Oceanic (Cfb)", "notes": "Cool, changeable" },
#     { "id": 18, "city": "Mexico City", "country": "Mexico", "climate": "Subtropical Highland (Cwb)", "notes": "Mild due to altitude" },
#     { "id": 19, "city": "São Paulo", "country": "Brazil", "climate": "Humid Subtropical (Cfa)", "notes": "Warm wet summers" },
#     { "id": 20, "city": "Buenos Aires", "country": "Argentina", "climate": "Humid Subtropical (Cfa)", "notes": "Hot summers, mild winters" },
#     { "id": 21, "city": "Los Angeles", "country": "USA", "climate": "Mediterranean (Csa)", "notes": "Hot dry summers, mild winters" }
#   ]
# }
panel_11 = Panel(concatenate)
model = Text("gpt-4o")
client = Text("openai")
panel_12 = Panel("gpt-4o")
panel_13 = Panel("openai")

# ---- group: VLM
python_3_script_6 = Python3Script(
    run=Toggle(True),
    project_name="HouseX",
    api_mode=client,
    model_id=model,
    use_mode="vlm",
    image_path=panel_8,
    system_prompt=panel_5,
    input_text=panel_11)  # -> out, response; inputs image_path: String
# ---------- python_3_script_6: Python ----------
import requests
import re
from ghpythonlib.treehelpers import list_to_tree

url = 'http://localhost:5000/llm_call'
# print(f"Sending db_path: {db_path}")
payload = {
    'input_text': input_text,
    'system_prompt': system_prompt,
    'image_path': image_path,
    'model_id': model_id,
    'project_name': project_name,
    'use_mode': use_mode,
    'api_mode':api_mode
}
print(payload)


response = None
question_classification = None
json_data = None

if run:
    response = requests.post(url, json=payload)
    
    if response.status_code == 200:
        data = response.json()
        response = data['response']
        
    else:
        out = "Failed to connect:"

print(response)
# ---------- end python_3_script_6 ----------

# ----
panel_14 = Panel(python_3_script_6.response)

# ---- group: prompt to LLM for planning
python_3_script_7 = Python3Script(site_info=panel_2, site_analysis=panel_14, users=panel_7)  # -> out, system_prompt, prompt
# ---------- python_3_script_7: Python ----------
system_prompt = """You are an architects copilot.  
Your task is to design a house based on a given **site analysis**, **local region**, **cultural context**, and **architectural best practices**.  

You must propose the **spaces, their adjacencies, and logical arrangement**, reflecting how inhabitants will move through and experience the home. Think like an architect:
- Snap rooms to one another logically, respecting circulation and adjacency.  
- If the house has multiple floors, include stairs and ensure stacked rooms align structurally.  
- Orient rooms correctly with **north at the top** of the site plan.  
- Reflect privacy, climate, and cultural expectations.  
- Output should be both **functional** and **experiential**, as if explaining a design intent.  

Your output must be **strictly valid JSON** conforming to the schema below.  
Do not include explanations, comments, or extra text—return **only JSON**.  

---

### JSON Schema
{
  "name": "<Design name, e.g. 'Linear house'>",
  "description": "<Brief description of the spatial concept>",
  "families": "<Family composition, e.g. '2 adults + 2 children'>",
  "profession": "<Primary profession(s) of family>",
  "location": "<City, Country>",
  "climate": "<Climate string, e.g. 'Arid'>",
  "roof_type": "<Roof type and material based on local and regional inspiration>",
  "facade_materials": "<Facade material(s) based on local and regional inspiration>",
  "floors": <integer number of floors>,
  "reason": "<Summary of key design decisions and site response>",
  "entry_strategy": {
    "side": "<north|south|east|west>",
    "anchor_point": [<float x>, <float y>],
    "rationale": "<short reason>"
  },

  "nodes": [
    {
      "id": "<unique identifier, lowercase>",
      "type": "<room type>",
      "center": [<float x>, <float y>],         // meters, relative to site_area
      "width": [<float, float>],                // room dimensions in meters (x,y)
      "height": <float>,                        // ceiling height in meters
      "floor": <integer>,                       // floor number
      "color": "<hex color string>",
      "features": "<unique attributes, e.g. skylight, sliding doors>"
    }
  ],

  "edges": [
    ["<node_id_A>", "<node_id_B>"]              // adjacency connections
  ],

  "site_area": {
    "width": <float>,                           // plot width in meters
    "height": <float>                           // plot depth in meters
  }
}

---

### Rules
- Every node must include: id, type, center, width, height, floor, and color.  
- Edges = logical circulation links (entry → living, living → kitchen, etc.).  
- **Entry node** must align with `entry_strategy.side` and its `anchor_point` inside the buildable zone.  
- Centers must respect **north-up orientation** of the site.  
- Floors must stack logically if >1.  
- Design must reflect **climate adaptation**, **privacy hierarchy**, and **cultural context**.  
- JSON must be valid: consistent quotes, commas, and closed brackets.  
- Output must be **one single JSON object** only.
"""


prompt = f"""Your task is to Design a house:  {users} Use the following site analysis as a starting guide to design the floor plan. Take into account where the entry should be and follow the design from there logically, think through it carefully and reflect on it before saying the solution:

{site_analysis}

Based on this site and context, return the **complete JSON design** following the schema provided in the system prompt.  

- Include all and add more spaces and connections to make the home functional, culturally appropriate, and inspiring for the inhabitants to live in their best space.  
- make sure the entry is correctly placed.  
- If multiple floors are needed, include stairs and ensure stacked rooms align structurally.  
- Reflect the **local climate**, **cultural expectations**, and **lifestyle needs** of the family.  
- Be creative like a world-class architect, ensuring each design decision improves the lived experience.
- Think through it step by step, and reflect on it before answering, so you get the best possible answer.  

Return only the JSON object, nothing else."""
# ---------- end python_3_script_7 ----------

# ----
panel_15 = Panel(python_3_script_7.system_prompt)
panel_16 = Panel(python_3_script_7.prompt)
panel_17 = Panel("""{
  "case_id": "<Unique identifier, e.g., CASE_001. Use string format.>",
  "vary": "<Optional variation parameter, leave null if not needed.>",
  "selection": {
    "location": {
      "id": "<Integer ID for location>",
      "city": "<City name>",
      "country": "<Country name>",
      "climate": "<Climate type, e.g., Köppen code>",
      "notes": "<Short notes about environmental/seasonal performance>"
    },
    "family": {
      "id": "<Integer ID for family>",
      "family": "<Family composition, e.g., '4 members (2 adults + 2 children)'>",
      "profession": "<Primary professions or roles>",
      "notes": "<Special needs, e.g., study, play, work-from-home>"
    },
    "planning": {
      "id": "<Integer ID for planning layout>",
      "name": "<Planning strategy, e.g., Linear, Courtyard, Cluster>",
      "bounds": {
        "width": "<Float, overall normalized width>",
        "height": "<Float, overall normalized height>",
        "margin": "<Float, outer margin>"
      },
      "routing": {
        "type": "<Routing type, e.g., corridor, loop>",
        "polyline": [
          [ "<x float>", "<y float>" ],
          [ "<x float>", "<y float>" ]
        ],
        "width": "<Float, corridor width>",
        "orientation": "<String, e.g., north-south>"
      },
      "nodes": [
        {
          "id": "<Node ID, e.g., ENTRY>",
          "role": "<Program role, e.g., Entry, Living, KitchenDining>",
          "center": [ "<x float>", "<y float>" ],
          "size": [ "<w float>", "<h float>" ]
        }
      ],
      "graph_edges": [
        [ "<NodeID1>", "<NodeID2>" ]
      ],
      "constraints": {
        "non_overlap": "<Boolean, true/false>",
        "min_gap": "<Float, minimum gap between elements>",
        "order_along_axis": {
          "axis": "<x or y>",
          "sequence": [ "<Ordered list of NodeIDs>" ]
        },
        "façade_priority": {
          "<direction>": [ "<NodeIDs that prefer this façade>" ]
        },
        "service_stack": [ "<NodeIDs sharing service stack>" ],
        "access_from_corridor": [ "<NodeIDs with corridor access>" ]
      },
      "placement_hints": [
        "<Optional freeform design hints, e.g., snapping rules>"
      ]
    }
  }
}""")
# """Design a single-family house in {{location.city}}, {{location.country}} (climate: {{location.climate}}). Family: {{family.family}} ({{family.profession}}). Use planning type '{{planning.name}}' with routing '{{planning.routing.type}}'. Site: {{site.name}}. Respect setbacks and produce a layout using the planning nodes/edges. Output JSON only following the given schema."""
panel_18 = Panel("""You are an architect's copilot. Reply in JSON matching the provided schema.
You are to review the site analysis and provide a design for a single family house. Take into account local region and cultural factors into the design and any architectural design considerations that will make this a good design.""")
panel_20 = Panel("gpt-oss-20b")
client_2 = Text("openai")
model_2 = Text("gpt-4o")
concatenate_2 = Concatenate(FragmentA=panel_18, FragmentB=panel_17)

# ---- group: LLM
python_3_script_8 = Python3Script(
    run=Toggle(True),
    project_name="HouseX",
    api_mode=client_2,
    model_id=model_2,
    use_mode="llm",
    system_prompt=panel_15,
    input_text=panel_16)  # -> out, response
# ---------- python_3_script_8: Python ----------
import requests
import re
from ghpythonlib.treehelpers import list_to_tree

url = 'http://localhost:5000/llm_call'
# print(f"Sending db_path: {db_path}")
payload = {
    'input_text': input_text,
    'model_id': model_id,
    'project_name': project_name,
    'use_mode': use_mode,
    'system_prompt': system_prompt,
    'input_text': input_text,
    'api_mode':api_mode
}
print(payload)


response = None
question_classification = None
json_data = None

if run:
    response = requests.post(url, json=payload)
    
    if response.status_code == 200:
        data = response.json()
        response = data['response']
        
    else:
        out = "Failed to connect:"

print(response)
# ---------- end python_3_script_8 ----------

# ----
seed = Integer(number_slider)
model_3 = Text(model)
siteidx = Integer(number_slider_3)
useridx = Integer(number_slider_4)
client_3 = Text(client)
file_path_2 = FilePath("G:\My Drive\MACAD\THESIS\outputs\houseplans\")
client_4 = Text(client_2)
model_4 = Text(model_2)
panel_21 = Panel(python_3_script_8.response)
python_3_script_9 = Python3Script(
    json_text=python_3_script_8.response,
    save_folder=file_path_2,
    SiteIDX=siteidx,
    UserIDX=useridx,
    seed=seed,
    modelvlm=model_3,
    clientvlm=client_3,
    modelllm=model_4,
    clientllm=client_4)  # -> out, room_breps, room_names, room_colors, floor_plan_img_path; inputs seed: Int32
# ---------- python_3_script_9: Python ----------
import os, json
import Rhino.Geometry as rg
from System.Drawing import Color

# -----------------------------
# Helpers
# -----------------------------
def hex_to_color(s, fallback=Color.LightGray):
    try:
        s = s.strip()
        if s.startswith("#"):
            s = s[1:]
        if len(s) == 3:
            s = "".join(ch*2 for ch in s)
        if len(s) != 6:
            return fallback
        r = int(s[0:2], 16)
        g = int(s[2:4], 16)
        b = int(s[4:6], 16)
        return Color.FromArgb(r, g, b)
    except:
        return fallback

def as_pair(v, default=(4.0, 4.0)):
    try:
        if isinstance(v, (list, tuple)) and len(v) == 2:
            return float(v[0]), float(v[1])
        f = float(v)
        return f, f
    except:
        return default

def make_box(center_xy, w, d, z0, h):
    cx, cy = float(center_xy[0]), float(center_xy[1])
    w, d, h = float(w), float(d), float(h)
    x0, x1 = cx - 0.5*w, cx + 0.5*w
    y0, y1 = cy - 0.5*d, cy + 0.5*d
    bb = rg.BoundingBox(rg.Point3d(x0, y0, z0), rg.Point3d(x1, y1, z0 + h))
    return rg.Box(bb).ToBrep()

# -----------------------------
# Parse JSON
# -----------------------------
try:
    data = json.loads(json_text)
except Exception as e:
    raise ValueError("Invalid JSON: {}".format(e))

nodes = data.get("nodes", [])
if not isinstance(nodes, list):
    nodes = []

F2F = float(floor_to_floor) if 'floor_to_floor' in globals() and floor_to_floor is not None else 3.2

# -----------------------------
# Build outputs
# -----------------------------
room_breps  = []
room_names  = []
room_colors = []

for n in nodes:
    nid    = str(n.get("id", "room")).strip()
    center = n.get("center", [0.0, 0.0])
    w, d   = as_pair(n.get("width", [4.0, 4.0]), default=(4.0, 4.0))
    h      = float(n.get("height", 3.0))
    floor  = int(n.get("floor", 0))
    color  = hex_to_color(n.get("color", "#CCCCCC"))

    z0     = floor * F2F
    brep   = make_box(center, w, d, z0, h)

    room_breps.append(brep)
    room_names.append(nid)
    room_colors.append(color)

# -----------------------------
# Save JSON to folder
# -----------------------------
# save_folder = r"C:\Users\user\Documents\SiteJSONs"  # <--- change this path
os.makedirs(save_folder, exist_ok=True)

# Build filename from design name or fallback
base_name = data.get("name", "site_design").replace(" ", "_")
file_path = os.path.join(save_folder, f"{base_name}_{SiteIDX}_{UserIDX}_{seed}_{modelvlm}_{modelllm}.json")
floor_plan_img_path = f"{base_name}_{SiteIDX}_{UserIDX}_{seed}_{modelvlm}_{modelllm}.png"

with open(file_path, "w", encoding="utf-8") as f:
    json.dump(data, f, indent=2)

print("JSON saved to:", file_path)
# ---------- end python_3_script_9 ----------
bounding_box = BoundingBox(Content=python_3_script_9.room_breps, Plane=PlaneXY(0, 0, 0), UnionBox=True)  # -> Box, Box_2
deconstruct_brep = DeconstructBrep(Brep=bounding_box.Box)  # -> Faces, Edges, Vertices
area_2 = Area(Geometry=deconstruct_brep.Faces)  # -> Area, Centroid
evaluate_surface = EvaluateSurface(Surface=deconstruct_brep.Faces, Point=area_2.Centroid)  # -> Point, Normal, UDirection, VDirection, Frame
unit_z = UnitZ(Factor=1)
dot_product = DotProduct(VectorA=evaluate_surface.Normal, VectorB=unit_z, Unitize=False)
equality = Equality(FirstNumber=dot_product, SecondNumber=Slider(-1, range=-1..1))  # -> Equality, Inequality
dispatch = Dispatch(List=deconstruct_brep.Faces, DispatchPattern=equality.Equality)  # -> ListA, ListB
site_center = Point(area.Centroid)
unit_z_2 = UnitZ(Factor=1)
area_3 = Area(Geometry=dispatch.ListA)  # -> Area, Centroid
vector_2pt = Vector2Pt(PointA=area_3.Centroid, PointB=site_center, Unitize=False)  # -> Vector, Length
move = Move(Geometry=python_3_script_9.room_breps, Motion=vector_2pt.Vector)  # -> Geometry, Transform
deconstruct_brep_2 = DeconstructBrep(Brep=move.Geometry)  # -> Faces, Edges, Vertices
area_4 = Area(Geometry=deconstruct_brep_2.Faces)  # -> Area, Centroid
evaluate_surface_2 = EvaluateSurface(Surface=deconstruct_brep_2.Faces, Point=area_4.Centroid)  # -> Point, Normal, UDirection, VDirection, Frame
dot_product_2 = DotProduct(VectorA=evaluate_surface_2.Normal, VectorB=unit_z_2, Unitize=False)
equality_2 = Equality(FirstNumber=dot_product_2, SecondNumber=Slider(1, range=-1..1))  # -> Equality, Inequality
list_length_2 = ListLength(List=move.Geometry)
larger_than = LargerThan(FirstNumber=list_length_2, SecondNumber=Slider(1, range=0..1))  # -> LargerThan, OrEqualTo
dispatch_2 = Dispatch(List=deconstruct_brep_2.Faces, DispatchPattern=equality_2.Equality)  # -> ListA, ListB
area_5 = Area(Geometry=dispatch_2.ListA)  # -> Area, Centroid
file_path_3 = FilePath("C:\Users\user\Documents\GitHub\ThesisDesignAgent\grasshopperFiles\house_plans\")
curve_7 = Curve(curve_3)
boolean = Boolean(larger_than.LargerThan)
custom_preview_6 = CustomPreview(Geometry=move.Geometry, Material=python_3_script_9.room_colors)

# ---- group: save plot for LLM
python_3_script_10 = Python3Script(run=boolean, plot_outline_curve=curve_7, SAVE_DIR=file_path_3, fname=python_3_script_9.floor_plan_img_path)  # -> out, png_path; inputs plot_outline_curve: Curve
# ---------- python_3_script_10: Python ----------
import os, base64, uuid, tempfile
import Rhino
import Rhino.Geometry as rg
import scriptcontext as sc
from System.Drawing.Imaging import ImageFormat

# --- Focus Top on plot outline (keeps it fully inside frame) ---
def focus_top_on(plot_geom, pad_frac=0.04, view_name="Top"):
    if plot_geom is None:
        raise ValueError("plot_geom is None")
    bbox = plot_geom.GetBoundingBox(True)
    if not bbox.IsValid:
        raise ValueError("Invalid plot bbox")

    # Pad the bbox a bit so geometry isn't glued to the image edge
    dx = bbox.Max.X - bbox.Min.X
    dy = bbox.Max.Y - bbox.Min.Y
    pad = max(dx, dy) * float(pad_frac)
    bbox = rg.BoundingBox(
        rg.Point3d(bbox.Min.X - pad, bbox.Min.Y - pad, bbox.Min.Z - 1.0),
        rg.Point3d(bbox.Max.X + pad, bbox.Max.Y + pad, bbox.Max.Z + 1.0)
    )

    # Find the Top view if it exists, otherwise use the active view
    view = sc.doc.Views.Find(view_name, False) or sc.doc.Views.ActiveView
    if view is None:
        raise RuntimeError("No Rhino view available")

    vp = view.ActiveViewport

    # Force a Top/parallel projection (try several APIs for compatibility)
    proj = Rhino.Display.DefinedViewportProjection.Top
    ok = False
    for args in [
        (proj, True, True, True),   # Rhino 8
        (proj, True, True),         # some builds
        (proj, True),               # some builds
        (proj,)                     # older builds
    ]:
        try:
            if vp.SetProjection(*args):
                ok = True
                break
        except:
            pass
    try:
        vp.ChangeToParallelProjection(True)
    except:
        pass
    try:
        vp.SetToPlanView(rg.Plane.WorldXY, True)
    except:
        pass

    # Canonical Top orientation
    try:
        vp.SetCameraDirection(rg.Vector3d(0, 0, -1), True)
    except:
        vp.CameraDirection = rg.Vector3d(0, 0, -1)
    vp.CameraUp = rg.Vector3d(0, 1, 0)

    # Clean capture (hide grids/axes)
    vp.ConstructionGridVisible = False
    vp.ConstructionAxesVisible = False
    vp.WorldAxesVisible = False

    # Zoom to bbox
    vp.ZoomBoundingBox(bbox)
    view.Redraw()
    return view

# --- Capture (instance-based ViewCapture → avoids your error) ---
import time

def capture_view(view, path, width=1400, height=1400, display_mode="Arctic", transparent=False):
    dm = Rhino.Display.DisplayModeDescription.FindByName(display_mode)
    if dm:
        view.ActiveViewport.DisplayMode = dm

    # Force redraw and give rendering a moment to catch up
    sc.doc.Views.Redraw()
    time.sleep(0.1)   # small pause (100ms), adjust if still too fast

    vc = Rhino.Display.ViewCapture()
    vc.Width = int(width)
    vc.Height = int(height)
    vc.ScaleScreenItems = False
    vc.DrawGrid = False
    vc.DrawAxes = False
    vc.DrawGridAxes = False
    vc.TransparentBackground = bool(transparent)

    bmp = vc.CaptureToBitmap(view)
    if bmp is None:
        raise RuntimeError("Capture failed (bitmap is None)")
    bmp.Save(path, ImageFormat.Png)
    return path

# --- Encode PNG/JPG to data-URI for LLMs ---
def encode_image_to_data_uri(path):
    ext = os.path.splitext(path)[1].lower().lstrip(".")
    mime = "image/jpeg" if ext in ("jpg", "jpeg") else "image/png"
    with open(path, "rb") as f:
        b64 = base64.b64encode(f.read()).decode("utf-8")
    return "data:%s;base64,%s" % (mime, b64)

# --- One-call helper: frame Top → capture → data-URI ---
def capture_topview_to_data_uri(plot_geom,
                                path=None,
                                width=1400,
                                height=1400,
                                pad_frac=0.04,
                                display_mode="Arctic",
                                transparent=False):
    import os, uuid, tempfile
    # If no explicit path, build one in SAVE_DIR (or temp if SAVE_DIR is not set/valid)
    if not path:
        out_dir = SAVE_DIR if (isinstance(SAVE_DIR, str) and len(SAVE_DIR) > 0) else tempfile.gettempdir()
        if not os.path.isdir(out_dir):
            try: os.makedirs(out_dir)
            except: out_dir = tempfile.gettempdir()
        path = os.path.join(out_dir, "site_top_%s.png" % uuid.uuid4().hex[:8])

    view = focus_top_on(plot_geom, pad_frac, view_name="Top")
    capture_view(view, path, width, height, display_mode, transparent)
    return path, encode_image_to_data_uri(path)
if run:
    path = os.path.join(SAVE_DIR, fname)
    png_path, data_uri = capture_topview_to_data_uri(plot_outline_curve,
                                                    path = path,
                                                    width=1600, height=1600,
                                                    display_mode="Rendered",
                                                    transparent=False)
# ---------- end python_3_script_10 ----------

# ----
text_tag_3d = TextTag3D(
    Location=area_5.Centroid,
    Text=graft(python_3_script_9.room_names),
    Size=Slider(0.3, range=0..1),
    Colour=ColourSwatch(SwatchColor=RGB(0, 0, 0)),
    Justification=5)
panel_22 = Panel(python_3_script_10.png_path)
